# Dynamo graph All.dyn (Dynamo 2.12.0.5650)
# packages: JsonData 2.0.2, archi-lab.net 2022.212.3222

# group: Get all views
code_block = CodeBlock { "Views"; }
byName = Category.ByName(name=code_block)
all_elements_of_category = ElementsOfCategory(Category=byName)

# group: Clean List
code_block_2 = CodeBlock { false; }
clean = List.Clean(list=all_elements_of_category, preserveIndices=code_block_2)

# group: Filter out View Templates
isViewTemplate = View.IsViewTemplate(view=clean)
filterByBoolMask = List.FilterByBoolMask(list=clean, mask=isViewTemplate)

# group: Get all paremeters of placed families
parameters = Element.Parameters(element=filterByBoolMask.out)

# group: Delete duplicates
string_from_object = FromObject(object=parameters)
uniqueItems = List.UniqueItems(list=string_from_object@L2)

# group: Split parameter name from value
string = StringInput(" : ")
split = String.Split(string=uniqueItems, separator0=string)
count = List.Count(list=split@@L2)
code_block_3 = CodeBlock { 1; }
eq = count@@L2 == code_block_3
filterByBoolMask_2 = List.FilterByBoolMask(list=split, mask=eq)
code_block_4 = CodeBlock { 0; }
removeItemAtIndex = List.RemoveItemAtIndex(list=filterByBoolMask_2.out@@L2, indices=code_block_4)
getItemAtIndex = List.GetItemAtIndex(list=filterByBoolMask_2.out@@L2, index=code_block_4)

# group: Concatinate additional : splits
code_block_5 = CodeBlock { " - "; }
join = String.Join(separator=code_block_5, string0=removeItemAtIndex@@L2)
code_block_6 = CodeBlock { 1; }
flatten = List.Flatten(list=join, amount=code_block_6)

# group: Remove : from fields
code_block_7 = CodeBlock { ":"; " "; }
replace = String.Replace(string=getItemAtIndex@@L2, searchFor=code_block_7.out0, replaceWith=code_block_7.out1)

# group: Group values by parameter name
groupByKey = List.GroupByKey(list=flatten@L2, keys=replace@L2)

# group: Add EID and GUID paramater slots
string_2 = StringInput("GUID")
string_3 = StringInput("EID")
addItemToFront = List.AddItemToFront(item=string_3, list=groupByKey.uniqueKeys@L2)
addItemToFront_2 = List.AddItemToFront(item=string_2, list=addItemToFront@L2)

# group: Concatinate additional : splits
code_block_8 = CodeBlock { " , "; }
join_2 = String.Join(separator=code_block_8, string0=groupByKey.groups@@L2)

# group: Add EID Value for each element
uniqueId = Element.UniqueId(element=filterByBoolMask.out)
string_from_object_2 = FromObject(object=uniqueId)
id = Element.Id(element=filterByBoolMask.out)
string_from_object_3 = FromObject(object=id)
addItemToFront_3 = List.AddItemToFront(item=string_from_object_3@L1, list=join_2@@L2)
addItemToFront_4 = List.AddItemToFront(item=string_from_object_2@L1, list=addItemToFront_3@@L2)

# group: Create a dictionary, then split out values and keys
byKeysValues = DesignScript.Builtin.Dictionary.ByKeysValues(keys=addItemToFront_2@L2, values=addItemToFront_4@L2)
keys = DesignScript.Builtin.Dictionary.Keys(dictionary=byKeysValues)
values = DesignScript.Builtin.Dictionary.Values(dictionary=byKeysValues)

# group: Name File
string_4 = StringInput("C:\Scratch\_Testing\")
now = DateTime.Now()
code_block_9 = CodeBlock { "yyMMdd-HHMMss_"; }
format = DateTime.Format(dateTime=now, format=code_block_9)
string_5 = StringInput(".json")

add = code_block + string_5

# group (continued): Name File
add_2 = format + add
add_3 = string_4 + add_2

# group: Create a JSON and save to path
byKeysAndValues = JsonObject.ByKeysAndValues(keys=keys@L2, values=values@L2, Nesting=true, Option="None")
toJsonFile = JsonData.Utilities.Write.ToJsonFile(jsonObjects=byKeysAndValues, filepath=add_3)

# group: Get all sheets
code_block_10 = CodeBlock { "Sheets"; }
byName_2 = Category.ByName(name=code_block_10)
all_elements_of_category_2 = ElementsOfCategory(Category=byName_2)

# group: Clean List
code_block_11 = CodeBlock { false; }
clean_2 = List.Clean(list=all_elements_of_category_2, preserveIndices=code_block_11)

# group: Get all paremeters of placed families
parameters_2 = Element.Parameters(element=clean_2)

# group: Delete duplicates
string_from_object_4 = FromObject(object=parameters_2)
uniqueItems_2 = List.UniqueItems(list=string_from_object_4@L2)

# group: Split parameter name from value
string_6 = StringInput(" : ")
split_2 = String.Split(string=uniqueItems_2, separator0=string_6)
count_2 = List.Count(list=split_2@@L2)
code_block_12 = CodeBlock { 1; }
eq_2 = count_2@@L2 == code_block_12
filterByBoolMask_3 = List.FilterByBoolMask(list=split_2, mask=eq_2)
code_block_13 = CodeBlock { 0; }
removeItemAtIndex_2 = List.RemoveItemAtIndex(list=filterByBoolMask_3.out@@L2, indices=code_block_13)
getItemAtIndex_2 = List.GetItemAtIndex(list=filterByBoolMask_3.out@@L2, index=code_block_13)

# group: Concatinate additional : splits
code_block_14 = CodeBlock { " - "; }
join_3 = String.Join(separator=code_block_14, string0=removeItemAtIndex_2@@L2)
code_block_15 = CodeBlock { 1; }
flatten_2 = List.Flatten(list=join_3, amount=code_block_15)

# group: Remove : from fields
code_block_16 = CodeBlock { ":"; " "; }
replace_2 = String.Replace(string=getItemAtIndex_2@@L2, searchFor=code_block_16.out0, replaceWith=code_block_16.out1)

# group: Group values by parameter name
groupByKey_2 = List.GroupByKey(list=flatten_2@L2, keys=replace_2@L2)

# group: Add EID and GUID paramater slots
string_7 = StringInput("GUID")
string_8 = StringInput("EID")
addItemToFront_5 = List.AddItemToFront(item=string_8, list=groupByKey_2.uniqueKeys@L2)
addItemToFront_6 = List.AddItemToFront(item=string_7, list=addItemToFront_5@L2)

# group: Concatinate additional : splits
code_block_17 = CodeBlock { " , "; }
join_4 = String.Join(separator=code_block_17, string0=groupByKey_2.groups@@L2)

# group: Add EID Value for each element
uniqueId_2 = Element.UniqueId(element=clean_2)
string_from_object_5 = FromObject(object=uniqueId_2)
id_2 = Element.Id(element=clean_2)
string_from_object_6 = FromObject(object=id_2)
addItemToFront_7 = List.AddItemToFront(item=string_from_object_6@L1, list=join_4@@L2)
addItemToFront_8 = List.AddItemToFront(item=string_from_object_5@L1, list=addItemToFront_7@@L2)

# group: Create a dictionary, then split out values and keys
byKeysValues_2 = DesignScript.Builtin.Dictionary.ByKeysValues(keys=addItemToFront_6@L2, values=addItemToFront_8@L2)
keys_2 = DesignScript.Builtin.Dictionary.Keys(dictionary=byKeysValues_2)
values_2 = DesignScript.Builtin.Dictionary.Values(dictionary=byKeysValues_2)

# group: Name File
string_9 = StringInput("C:\Scratch\_Testing\")
now_2 = DateTime.Now()
code_block_18 = CodeBlock { "yyMMdd-HHMMss_"; }
format_2 = DateTime.Format(dateTime=now_2, format=code_block_18)
string_10 = StringInput(".json")

add_4 = code_block_10 + string_10

# group (continued): Name File
add_5 = format_2 + add_4
add_6 = string_9 + add_5

# group: Create a JSON and save to path
byKeysAndValues_2 = JsonObject.ByKeysAndValues(keys=keys_2@L2, values=values_2@L2, Nesting=true, Option="None")
toJsonFile_2 = JsonData.Utilities.Write.ToJsonFile(jsonObjects=byKeysAndValues_2, filepath=add_6)

# group: Get all links
getDocuments = archilab.Revit.Selection.Select.GetDocuments()

# group: Clean List
code_block_19 = CodeBlock { false; }
clean_3 = List.Clean(list=getDocuments.Link_Instance, preserveIndices=code_block_19)

# group: Get all paremeters of placed families
parameters_3 = Element.Parameters(element=clean_3)

# group: Delete duplicates
string_from_object_7 = FromObject(object=parameters_3)
uniqueItems_3 = List.UniqueItems(list=string_from_object_7@L2)

# group: Split parameter name from value
string_11 = StringInput(" : ")
split_3 = String.Split(string=uniqueItems_3, separator0=string_11)
count_3 = List.Count(list=split_3@@L2)
code_block_20 = CodeBlock { 1; }
eq_3 = count_3@@L2 == code_block_20
filterByBoolMask_4 = List.FilterByBoolMask(list=split_3, mask=eq_3)
code_block_21 = CodeBlock { 0; }
removeItemAtIndex_3 = List.RemoveItemAtIndex(list=filterByBoolMask_4.out@@L2, indices=code_block_21)
getItemAtIndex_3 = List.GetItemAtIndex(list=filterByBoolMask_4.out@@L2, index=code_block_21)

# group: Concatinate additional : splits
code_block_22 = CodeBlock { " - "; }
join_5 = String.Join(separator=code_block_22, string0=removeItemAtIndex_3@@L2)
code_block_23 = CodeBlock { 1; }
flatten_3 = List.Flatten(list=join_5, amount=code_block_23)

# group: Remove : from fields
code_block_24 = CodeBlock { ":"; " "; }
replace_3 = String.Replace(string=getItemAtIndex_3@@L2, searchFor=code_block_24.out0, replaceWith=code_block_24.out1)

# group: Group values by parameter name
groupByKey_3 = List.GroupByKey(list=flatten_3@L2, keys=replace_3@L2)

# group: Add EID and GUID paramater slots
string_12 = StringInput("GUID")
string_13 = StringInput("EID")
addItemToFront_9 = List.AddItemToFront(item=string_13, list=groupByKey_3.uniqueKeys@L2)
addItemToFront_10 = List.AddItemToFront(item=string_12, list=addItemToFront_9@L2)

# group: Concatinate additional : splits
code_block_25 = CodeBlock { " , "; }
join_6 = String.Join(separator=code_block_25, string0=groupByKey_3.groups@@L2)

# group: Add EID Value for each element
uniqueId_3 = Element.UniqueId(element=clean_3)
string_from_object_8 = FromObject(object=uniqueId_3)
id_3 = Element.Id(element=clean_3)
string_from_object_9 = FromObject(object=id_3)
addItemToFront_11 = List.AddItemToFront(item=string_from_object_9@L1, list=join_6@@L2)
addItemToFront_12 = List.AddItemToFront(item=string_from_object_8@L1, list=addItemToFront_11@@L2)

# group: Add file path parameter name and value
string_14 = StringInput("Path")
addItemToFront_13 = List.AddItemToFront(item=string_14, list=addItemToFront_10@L2)
string_from_object_10 = FromObject(object=getDocuments.Link_Path)
addItemToFront_14 = List.AddItemToFront(item=string_from_object_10@L1, list=addItemToFront_12@@L2)

# group: Create a dictionary, then split out values and keys
byKeysValues_3 = DesignScript.Builtin.Dictionary.ByKeysValues(keys=addItemToFront_13@L2, values=addItemToFront_14@L2)
keys_3 = DesignScript.Builtin.Dictionary.Keys(dictionary=byKeysValues_3)
values_3 = DesignScript.Builtin.Dictionary.Values(dictionary=byKeysValues_3)

# group: Name File
string_15 = StringInput("C:\Scratch\_Testing\")
now_3 = DateTime.Now()
code_block_26 = CodeBlock { "yyMMdd-HHMMss_"; }
format_3 = DateTime.Format(dateTime=now_3, format=code_block_26)
string_16 = StringInput(".json")

string_17 = StringInput("Links")
add_7 = string_17 + string_16

# group (continued): Name File
add_8 = format_3 + add_7
add_9 = string_15 + add_8

# group: Create a JSON and save to path
byKeysAndValues_3 = JsonObject.ByKeysAndValues(keys=keys_3@L2, values=values_3@L2, Nesting=true, Option="None")
toJsonFile_3 = JsonData.Utilities.Write.ToJsonFile(jsonObjects=byKeysAndValues_3, filepath=add_9)

# group: Manually added parameter names
code_block_27 = CodeBlock { ["Severity","Description"]; }

# group: Get the current document
current = Document.Current()

# group: Get warnings and pull out severity and description
getWarnings = Warning.GetWarnings(document=current)
severity = Warning.Severity(warning=getWarnings)
description = Warning.Description(warning=getWarnings)

# group: Format the warning values
list_create = List.Create(item0=severity, item1=description)
transpose = List.Transpose(lists=list_create)

# group: Create a dictionary, then split out values and keys
byKeysValues_4 = DesignScript.Builtin.Dictionary.ByKeysValues(keys=code_block_27, values=transpose@L2)
keys_4 = DesignScript.Builtin.Dictionary.Keys(dictionary=byKeysValues_4)
values_4 = DesignScript.Builtin.Dictionary.Values(dictionary=byKeysValues_4)

# group: Name File
string_18 = StringInput("C:\Scratch\_Testing\")
now_4 = DateTime.Now()
code_block_28 = CodeBlock { "yyMMdd-HHMMss"; }
format_4 = DateTime.Format(dateTime=now_4, format=code_block_28)
string_19 = StringInput("_Warnings.json")
add_10 = format_4 + string_19
add_11 = string_18 + add_10

# group: Create a JSON and save to path
byKeysAndValues_4 = JsonObject.ByKeysAndValues(keys=keys_4@L2, values=values_4@L2, Nesting=true, Option="None")
toJsonFile_4 = JsonData.Utilities.Write.ToJsonFile(jsonObjects=byKeysAndValues_4, filepath=add_11)

# group: Get all model and annotation elements
getAll = archilab.Revit.Elements.Categories.GetAll()
byCategory = archilab.Revit.Selection.Select.ByCategory(category=getAll.Model)
byCategory_2 = archilab.Revit.Selection.Select.ByCategory(category=getAll.Annotation)
list_create_2 = List.Create(item0=byCategory, item1=byCategory_2)
flatten_4 = List.Flatten(list=list_create_2)

# group: Remove null values
code_block_29 = CodeBlock { false; }
clean_4 = List.Clean(list=flatten_4, preserveIndices=code_block_29)

# group: Get all paremeters of placed families
parameters_4 = Element.Parameters(element=clean_4)

# group: Remove duplicates
string_from_object_11 = FromObject(object=parameters_4)
uniqueItems_4 = List.UniqueItems(list=string_from_object_11@L2)

# group: Split parameter name from value
string_20 = StringInput(" : ")
split_4 = String.Split(string=uniqueItems_4, separator0=string_20)
count_4 = List.Count(list=split_4@@L2)
code_block_30 = CodeBlock { 1; }
eq_4 = count_4@@L2 == code_block_30
filterByBoolMask_5 = List.FilterByBoolMask(list=split_4, mask=eq_4)
code_block_31 = CodeBlock { 0; }
removeItemAtIndex_4 = List.RemoveItemAtIndex(list=filterByBoolMask_5.out@@L2, indices=code_block_31)
getItemAtIndex_4 = List.GetItemAtIndex(list=filterByBoolMask_5.out@@L2, index=code_block_31)

# group: Concatinate additional : splits
code_block_32 = CodeBlock { " - "; }
join_7 = String.Join(separator=code_block_32, string0=removeItemAtIndex_4@@L2)
code_block_33 = CodeBlock { 1; }
flatten_5 = List.Flatten(list=join_7, amount=code_block_33)

# group: Remove : from fields
code_block_34 = CodeBlock { ":"; " "; }
replace_4 = String.Replace(string=getItemAtIndex_4@@L2, searchFor=code_block_34.out0, replaceWith=code_block_34.out1)

# group: Group parameter vaules with the same parameter name
groupByKey_4 = List.GroupByKey(list=flatten_5@L2, keys=replace_4@L2)

# group: Create list of all parameters
flatten_6 = List.Flatten(list=groupByKey_4.uniqueKeys)
uniqueItems_5 = List.UniqueItems(list=flatten_6)
code_block_35 = CodeBlock { ""; }
count_5 = List.Count(list=uniqueItems_5)
ofRepeatedItem = List.OfRepeatedItem(item=code_block_35, amount=count_5)

# group: Add EID and GUID paramater slots
string_21 = StringInput("GUID")
string_22 = StringInput("EID")
addItemToFront_15 = List.AddItemToFront(item=string_22, list=groupByKey_4.uniqueKeys@L2)
addItemToFront_16 = List.AddItemToFront(item=string_21, list=addItemToFront_15@L2)

# group: Concatinate additional splits
code_block_36 = CodeBlock { " ¦ "; }
join_8 = String.Join(separator=code_block_36, string0=groupByKey_4.groups@@L2)

# group: Add EID Value for each element
uniqueId_4 = Element.UniqueId(element=clean_4)
string_from_object_12 = FromObject(object=uniqueId_4)
id_4 = Element.Id(element=clean_4)
string_from_object_13 = FromObject(object=id_4)
addItemToFront_17 = List.AddItemToFront(item=string_from_object_13@L1, list=join_8@@L2)
addItemToFront_18 = List.AddItemToFront(item=string_from_object_12@L1, list=addItemToFront_17@@L2)
code_block_37 = CodeBlock { 1; }
flatten_7 = List.Flatten(list=addItemToFront_18, amount=code_block_37)

# group: Add line item with all parameters
addItemToFront_19 = List.AddItemToFront(item=uniqueItems_5, list=addItemToFront_16)
addItemToFront_20 = List.AddItemToFront(item=ofRepeatedItem, list=flatten_7)

# group: Create a dictionary, then split out values and keys
byKeysValues_5 = DesignScript.Builtin.Dictionary.ByKeysValues(keys=addItemToFront_19@L2, values=addItemToFront_20@L2)
keys_5 = DesignScript.Builtin.Dictionary.Keys(dictionary=byKeysValues_5)
values_5 = DesignScript.Builtin.Dictionary.Values(dictionary=byKeysValues_5)

# group: Name File
string_23 = StringInput("C:\Scratch\_Testing\")
now_5 = DateTime.Now()
code_block_38 = CodeBlock { "yyMMdd-HHMMss_"; }
format_5 = DateTime.Format(dateTime=now_5, format=code_block_38)
code_block_39 = CodeBlock { "Elements"; }
string_24 = StringInput(".json")
add_12 = code_block_39 + string_24
add_13 = format_5 + add_12
add_14 = string_23 + add_13

# group: Create a JSON and save to path
byKeysAndValues_5 = JsonObject.ByKeysAndValues(keys=keys_5@L2, values=values_5@L2, Nesting=true, Option="None")
toJsonFile_5 = JsonData.Utilities.Write.ToJsonFile(jsonObjects=byKeysAndValues_5, filepath=add_14)
