# Dynamo graph Elements.dyn (Dynamo 2.12.0.5650)
# packages: JsonData 2.0.2, archi-lab.net 2022.212.3222

# group: Get all model and annotation elements
getAll = archilab.Revit.Elements.Categories.GetAll()
byCategory = archilab.Revit.Selection.Select.ByCategory(category=getAll.Model)
byCategory_2 = archilab.Revit.Selection.Select.ByCategory(category=getAll.Annotation)
list_create = List.Create(item0=byCategory, item1=byCategory_2)
flatten = List.Flatten(list=list_create)

# group: Remove null values
code_block = CodeBlock { false; }
clean = List.Clean(list=flatten, preserveIndices=code_block)

# group: Get all paremeters of placed families
parameters = Element.Parameters(element=clean)

# group: Remove duplicates and .
string_from_object = FromObject(object=parameters)
uniqueItems = List.UniqueItems(list=string_from_object@L2)
code_block_2 = CodeBlock { "."; ""; }
replace = String.Replace(string=uniqueItems@L2, searchFor=code_block_2.out0, replaceWith=code_block_2.out1)

# group: Split parameter name from value
string = StringInput(" : ")
split = String.Split(string=replace, separator0=string)
count = List.Count(list=split@@L2)
code_block_3 = CodeBlock { 1; }
eq = count@@L2 == code_block_3
filterByBoolMask = List.FilterByBoolMask(list=split, mask=eq)
code_block_4 = CodeBlock { 0; }
removeItemAtIndex = List.RemoveItemAtIndex(list=filterByBoolMask.out@@L2, indices=code_block_4)
getItemAtIndex = List.GetItemAtIndex(list=filterByBoolMask.out@@L2, index=code_block_4)

# group: Concatinate additional : splits
code_block_5 = CodeBlock { " - "; }
join = String.Join(separator=code_block_5, string0=removeItemAtIndex@@L2)
code_block_6 = CodeBlock { 1; }
flatten_2 = List.Flatten(list=join, amount=code_block_6)

# group: Remove : from fields
code_block_7 = CodeBlock { ":"; " "; }
replace_2 = String.Replace(string=getItemAtIndex@@L2, searchFor=code_block_7.out0, replaceWith=code_block_7.out1)

# group: Group parameter vaules with the same parameter name
groupByKey = List.GroupByKey(list=flatten_2@L2, keys=replace_2@L2)

# group: Create list of all parameters
flatten_3 = List.Flatten(list=groupByKey.uniqueKeys)
uniqueItems_2 = List.UniqueItems(list=flatten_3)
code_block_8 = CodeBlock { ""; }
count_2 = List.Count(list=uniqueItems_2)
ofRepeatedItem = List.OfRepeatedItem(item=code_block_8, amount=count_2)

# group: Add EID and GUID paramater slots
string_2 = StringInput("GUID")
string_3 = StringInput("EID")
addItemToFront = List.AddItemToFront(item=string_3, list=groupByKey.uniqueKeys@L2)
addItemToFront_2 = List.AddItemToFront(item=string_2, list=addItemToFront@L2)

# group: Concatinate additional splits
code_block_9 = CodeBlock { " ¦ "; }
join_2 = String.Join(separator=code_block_9, string0=groupByKey.groups@@L2)

# group: Add EID Value for each element
uniqueId = Element.UniqueId(element=clean)
string_from_object_2 = FromObject(object=uniqueId)
id = Element.Id(element=clean)
string_from_object_3 = FromObject(object=id)
addItemToFront_3 = List.AddItemToFront(item=string_from_object_3@L1, list=join_2@@L2)
addItemToFront_4 = List.AddItemToFront(item=string_from_object_2@L1, list=addItemToFront_3@@L2)
code_block_10 = CodeBlock { 1; }
flatten_4 = List.Flatten(list=addItemToFront_4, amount=code_block_10)

# group: Add line item with all parameters
addItemToFront_5 = List.AddItemToFront(item=uniqueItems_2, list=addItemToFront_2)
addItemToFront_6 = List.AddItemToFront(item=ofRepeatedItem, list=flatten_4)

# group: Create a dictionary, then split out values and keys
byKeysValues = DesignScript.Builtin.Dictionary.ByKeysValues(keys=addItemToFront_5@L2, values=addItemToFront_6@L2)
keys = DesignScript.Builtin.Dictionary.Keys(dictionary=byKeysValues)
values = DesignScript.Builtin.Dictionary.Values(dictionary=byKeysValues)

# group: Name File
string_4 = StringInput("C:\Scratch\_Testing\")
now = DateTime.Now()
code_block_11 = CodeBlock { "yyMMdd-HHMMss_"; }
format = DateTime.Format(dateTime=now, format=code_block_11)
code_block_12 = CodeBlock { "Elements"; }
string_5 = StringInput(".json")
add = code_block_12 + string_5
add_2 = format + add
add_3 = string_4 + add_2

# group: Create a JSON and save to path
byKeysAndValues = JsonObject.ByKeysAndValues(keys=keys@L2, values=values@L2, Nesting=true, Option="None")
toJsonFile = JsonData.Utilities.Write.ToJsonFile(jsonObjects=byKeysAndValues, filepath=add_3)
