# Dynamo graph ViewsSheetsLinks.dyn (Dynamo 2.12.0.5650)
# packages: JsonData 2.0.2, archi-lab.net 2022.212.3222

# group: Get all views
code_block = CodeBlock { "Views"; }
byName = Category.ByName(name=code_block)
all_elements_of_category = ElementsOfCategory(Category=byName)

# group: Clean List
code_block_2 = CodeBlock { false; }
clean = List.Clean(list=all_elements_of_category, preserveIndices=code_block_2)

# group: Filter out View Templates
isViewTemplate = View.IsViewTemplate(view=clean)
filterByBoolMask = List.FilterByBoolMask(list=clean, mask=isViewTemplate)

# group: Get all paremeters of placed families
parameters = Element.Parameters(element=filterByBoolMask.out)

# group: Add parameter ID to parameter name
string_from_object = FromObject(object=parameters)
uniqueItems = List.UniqueItems(list=string_from_object@L2)
code_block_3 = CodeBlock { "."; ""; }
replace = String.Replace(string=uniqueItems@L2, searchFor=code_block_3.out0, replaceWith=code_block_3.out1)

# group: Split parameter name from value
string = StringInput(" : ")
split = String.Split(string=replace, separator0=string)
count = List.Count(list=split@@L2)
code_block_4 = CodeBlock { 1; }
eq = count@@L2 == code_block_4
filterByBoolMask_2 = List.FilterByBoolMask(list=split, mask=eq)
code_block_5 = CodeBlock { 0; }
removeItemAtIndex = List.RemoveItemAtIndex(list=filterByBoolMask_2.out@@L2, indices=code_block_5)
getItemAtIndex = List.GetItemAtIndex(list=filterByBoolMask_2.out@@L2, index=code_block_5)

# group: Concatinate additional : splits
code_block_6 = CodeBlock { " - "; }
join = String.Join(separator=code_block_6, string0=removeItemAtIndex@@L2)
code_block_7 = CodeBlock { 1; }
flatten = List.Flatten(list=join, amount=code_block_7)

# group: Remove : from fields
code_block_8 = CodeBlock { ":"; " "; }
replace_2 = String.Replace(string=getItemAtIndex@@L2, searchFor=code_block_8.out0, replaceWith=code_block_8.out1)

# group: Group values by parameter name
groupByKey = List.GroupByKey(list=flatten@L2, keys=replace_2@L2)

# group: Add EID and GUID paramater slots
string_2 = StringInput("GUID")
string_3 = StringInput("EID")
addItemToFront = List.AddItemToFront(item=string_3, list=groupByKey.uniqueKeys@L2)
addItemToFront_2 = List.AddItemToFront(item=string_2, list=addItemToFront@L2)

# group: Concatinate additional : splits
code_block_9 = CodeBlock { " , "; }
join_2 = String.Join(separator=code_block_9, string0=groupByKey.groups@@L2)

# group: Add EID Value for each element
uniqueId = Element.UniqueId(element=filterByBoolMask.out)
string_from_object_2 = FromObject(object=uniqueId)
id = Element.Id(element=filterByBoolMask.out)
string_from_object_3 = FromObject(object=id)
addItemToFront_3 = List.AddItemToFront(item=string_from_object_3@L1, list=join_2@@L2)
addItemToFront_4 = List.AddItemToFront(item=string_from_object_2@L1, list=addItemToFront_3@@L2)

# group: Create a dictionary, then split out values and keys
byKeysValues = DesignScript.Builtin.Dictionary.ByKeysValues(keys=addItemToFront_2@L2, values=addItemToFront_4@L2)
keys = DesignScript.Builtin.Dictionary.Keys(dictionary=byKeysValues)
values = DesignScript.Builtin.Dictionary.Values(dictionary=byKeysValues)

# group: Name File
string_4 = StringInput("C:\Scratch\_Testing\")
now = DateTime.Now()
code_block_10 = CodeBlock { "yyMMdd-HHMMss_"; }
format = DateTime.Format(dateTime=now, format=code_block_10)
string_5 = StringInput(".json")

add = code_block + string_5

# group (continued): Name File
add_2 = format + add
add_3 = string_4 + add_2

# group: Create a JSON and save to path
byKeysAndValues = JsonObject.ByKeysAndValues(keys=keys@L2, values=values@L2, Nesting=true, Option="None")
toJsonFile = JsonData.Utilities.Write.ToJsonFile(jsonObjects=byKeysAndValues, filepath=add_3)

# group: Get all sheets
code_block_11 = CodeBlock { "Sheets"; }
byName_2 = Category.ByName(name=code_block_11)
all_elements_of_category_2 = ElementsOfCategory(Category=byName_2)

# group: Clean List
code_block_12 = CodeBlock { false; }
clean_2 = List.Clean(list=all_elements_of_category_2, preserveIndices=code_block_12)

# group: Get all paremeters of placed families
parameters_2 = Element.Parameters(element=clean_2)

# group: Add parameter ID to parameter name
string_from_object_4 = FromObject(object=parameters_2)
uniqueItems_2 = List.UniqueItems(list=string_from_object_4@L2)
code_block_13 = CodeBlock { "."; ""; }
replace_3 = String.Replace(string=uniqueItems_2@L2, searchFor=code_block_13.out0, replaceWith=code_block_13.out1)

# group: Split parameter name from value
string_6 = StringInput(" : ")
split_2 = String.Split(string=replace_3, separator0=string_6)
count_2 = List.Count(list=split_2@@L2)
code_block_14 = CodeBlock { 1; }
eq_2 = count_2@@L2 == code_block_14
filterByBoolMask_3 = List.FilterByBoolMask(list=split_2, mask=eq_2)
code_block_15 = CodeBlock { 0; }
removeItemAtIndex_2 = List.RemoveItemAtIndex(list=filterByBoolMask_3.out@@L2, indices=code_block_15)
getItemAtIndex_2 = List.GetItemAtIndex(list=filterByBoolMask_3.out@@L2, index=code_block_15)

# group: Concatinate additional : splits
code_block_16 = CodeBlock { " - "; }
join_3 = String.Join(separator=code_block_16, string0=removeItemAtIndex_2@@L2)
code_block_17 = CodeBlock { 1; }
flatten_2 = List.Flatten(list=join_3, amount=code_block_17)

# group: Remove : from fields
code_block_18 = CodeBlock { ":"; " "; }
replace_4 = String.Replace(string=getItemAtIndex_2@@L2, searchFor=code_block_18.out0, replaceWith=code_block_18.out1)

# group: Group values by parameter name
groupByKey_2 = List.GroupByKey(list=flatten_2@L2, keys=replace_4@L2)

# group: Add EID and GUID paramater slots
string_7 = StringInput("GUID")
string_8 = StringInput("EID")
addItemToFront_5 = List.AddItemToFront(item=string_8, list=groupByKey_2.uniqueKeys@L2)
addItemToFront_6 = List.AddItemToFront(item=string_7, list=addItemToFront_5@L2)

# group: Concatinate additional : splits
code_block_19 = CodeBlock { " , "; }
join_4 = String.Join(separator=code_block_19, string0=groupByKey_2.groups@@L2)

# group: Add EID Value for each element
uniqueId_2 = Element.UniqueId(element=clean_2)
string_from_object_5 = FromObject(object=uniqueId_2)
id_2 = Element.Id(element=clean_2)
string_from_object_6 = FromObject(object=id_2)
addItemToFront_7 = List.AddItemToFront(item=string_from_object_6@L1, list=join_4@@L2)
addItemToFront_8 = List.AddItemToFront(item=string_from_object_5@L1, list=addItemToFront_7@@L2)

# group: Create a dictionary, then split out values and keys
byKeysValues_2 = DesignScript.Builtin.Dictionary.ByKeysValues(keys=addItemToFront_6@L2, values=addItemToFront_8@L2)
keys_2 = DesignScript.Builtin.Dictionary.Keys(dictionary=byKeysValues_2)
values_2 = DesignScript.Builtin.Dictionary.Values(dictionary=byKeysValues_2)

# group: Name File
string_9 = StringInput("C:\Scratch\_Testing\")
now_2 = DateTime.Now()
code_block_20 = CodeBlock { "yyMMdd-HHMMss_"; }
format_2 = DateTime.Format(dateTime=now_2, format=code_block_20)
string_10 = StringInput(".json")

add_4 = code_block_11 + string_10

# group (continued): Name File
add_5 = format_2 + add_4
add_6 = string_9 + add_5

# group: Create a JSON and save to path
byKeysAndValues_2 = JsonObject.ByKeysAndValues(keys=keys_2@L2, values=values_2@L2, Nesting=true, Option="None")
toJsonFile_2 = JsonData.Utilities.Write.ToJsonFile(jsonObjects=byKeysAndValues_2, filepath=add_6)

# group: Get all links
getDocuments = archilab.Revit.Selection.Select.GetDocuments()

# group: Clean List
code_block_21 = CodeBlock { false; }
clean_3 = List.Clean(list=getDocuments.Link_Instance, preserveIndices=code_block_21)

# group: Get all paremeters of placed families
parameters_3 = Element.Parameters(element=clean_3)

# group: Add parameter ID to parameter name
string_from_object_7 = FromObject(object=parameters_3)
uniqueItems_3 = List.UniqueItems(list=string_from_object_7@L2)
code_block_22 = CodeBlock { "."; ""; }
replace_5 = String.Replace(string=uniqueItems_3@L2, searchFor=code_block_22.out0, replaceWith=code_block_22.out1)

# group: Split parameter name from value
string_11 = StringInput(" : ")
split_3 = String.Split(string=replace_5, separator0=string_11)
count_3 = List.Count(list=split_3@@L2)
code_block_23 = CodeBlock { 1; }
eq_3 = count_3@@L2 == code_block_23
filterByBoolMask_4 = List.FilterByBoolMask(list=split_3, mask=eq_3)
code_block_24 = CodeBlock { 0; }
removeItemAtIndex_3 = List.RemoveItemAtIndex(list=filterByBoolMask_4.out@@L2, indices=code_block_24)
getItemAtIndex_3 = List.GetItemAtIndex(list=filterByBoolMask_4.out@@L2, index=code_block_24)

# group: Concatinate additional : splits
code_block_25 = CodeBlock { " - "; }
join_5 = String.Join(separator=code_block_25, string0=removeItemAtIndex_3@@L2)
code_block_26 = CodeBlock { 1; }
flatten_3 = List.Flatten(list=join_5, amount=code_block_26)

# group: Remove : from fields
code_block_27 = CodeBlock { ":"; " "; }
replace_6 = String.Replace(string=getItemAtIndex_3@@L2, searchFor=code_block_27.out0, replaceWith=code_block_27.out1)

# group: Group values by parameter name
groupByKey_3 = List.GroupByKey(list=flatten_3@L2, keys=replace_6@L2)

# group: Add EID and GUID paramater slots
string_12 = StringInput("GUID")
string_13 = StringInput("EID")
addItemToFront_9 = List.AddItemToFront(item=string_13, list=groupByKey_3.uniqueKeys@L2)
addItemToFront_10 = List.AddItemToFront(item=string_12, list=addItemToFront_9@L2)

# group: Concatinate additional : splits
code_block_28 = CodeBlock { " , "; }
join_6 = String.Join(separator=code_block_28, string0=groupByKey_3.groups@@L2)

# group: Add EID Value for each element
uniqueId_3 = Element.UniqueId(element=clean_3)
string_from_object_8 = FromObject(object=uniqueId_3)
id_3 = Element.Id(element=clean_3)
string_from_object_9 = FromObject(object=id_3)
addItemToFront_11 = List.AddItemToFront(item=string_from_object_9@L1, list=join_6@@L2)
addItemToFront_12 = List.AddItemToFront(item=string_from_object_8@L1, list=addItemToFront_11@@L2)

# group: Add file path parameter name and value
string_14 = StringInput("Path")
addItemToFront_13 = List.AddItemToFront(item=string_14, list=addItemToFront_10@L2)
string_from_object_10 = FromObject(object=getDocuments.Link_Path)
addItemToFront_14 = List.AddItemToFront(item=string_from_object_10@L1, list=addItemToFront_12@@L2)

# group: Create a dictionary, then split out values and keys
byKeysValues_3 = DesignScript.Builtin.Dictionary.ByKeysValues(keys=addItemToFront_13@L2, values=addItemToFront_14@L2)
keys_3 = DesignScript.Builtin.Dictionary.Keys(dictionary=byKeysValues_3)
values_3 = DesignScript.Builtin.Dictionary.Values(dictionary=byKeysValues_3)

# group: Name File
string_15 = StringInput("C:\Scratch\_Testing\")
now_3 = DateTime.Now()
code_block_29 = CodeBlock { "yyMMdd-HHMMss_"; }
format_3 = DateTime.Format(dateTime=now_3, format=code_block_29)
string_16 = StringInput(".json")

string_17 = StringInput("Links")
add_7 = string_17 + string_16

# group (continued): Name File
add_8 = format_3 + add_7
add_9 = string_15 + add_8

# group: Create a JSON and save to path
byKeysAndValues_3 = JsonObject.ByKeysAndValues(keys=keys_3@L2, values=values_3@L2, Nesting=true, Option="None")
toJsonFile_3 = JsonData.Utilities.Write.ToJsonFile(jsonObjects=byKeysAndValues_3, filepath=add_9)

# group: Manually added parameter names
code_block_30 = CodeBlock { ["Severity","Description"]; }

# group: Get the current document
current = Document.Current()

# group: Get warnings and pull out severity and description
getWarnings = Warning.GetWarnings(document=current)
severity = Warning.Severity(warning=getWarnings)
description = Warning.Description(warning=getWarnings)

# group: Format the warning values
list_create = List.Create(item0=severity, item1=description)
transpose = List.Transpose(lists=list_create)

# group: Create a dictionary, then split out values and keys
byKeysValues_4 = DesignScript.Builtin.Dictionary.ByKeysValues(keys=code_block_30, values=transpose@L2)
keys_4 = DesignScript.Builtin.Dictionary.Keys(dictionary=byKeysValues_4)
values_4 = DesignScript.Builtin.Dictionary.Values(dictionary=byKeysValues_4)

# group: Name File
string_18 = StringInput("C:\Scratch\_Testing\")
now_4 = DateTime.Now()
code_block_31 = CodeBlock { "yyMMdd-HHMMss"; }
format_4 = DateTime.Format(dateTime=now_4, format=code_block_31)
string_19 = StringInput("_Warnings.json")
add_10 = format_4 + string_19
add_11 = string_18 + add_10

# group: Create a JSON and save to path
byKeysAndValues_4 = JsonObject.ByKeysAndValues(keys=keys_4@L2, values=values_4@L2, Nesting=true, Option="None")
toJsonFile_4 = JsonData.Utilities.Write.ToJsonFile(jsonObjects=byKeysAndValues_4, filepath=add_11)
