# Dynamo graph Warnings.dyn (Dynamo 2.12.0.5650)
# packages: JsonData 2.0.2

code_block = CodeBlock { ["Severity","Description"]; }

# group: Get the current document
current = Document.Current()

getWarnings = Warning.GetWarnings(document=current)
severity = Warning.Severity(warning=getWarnings)
description = Warning.Description(warning=getWarnings)
list_create = List.Create(item0=severity, item1=description)
transpose = List.Transpose(lists=list_create)

# group: Create a dictionary, then split out values and keys
byKeysValues = DesignScript.Builtin.Dictionary.ByKeysValues(keys=code_block, values=transpose@L2)
keys = DesignScript.Builtin.Dictionary.Keys(dictionary=byKeysValues)
values = DesignScript.Builtin.Dictionary.Values(dictionary=byKeysValues)

# group: Name File
string = StringInput("C:\Scratch\_Testing\")
now = DateTime.Now()
code_block_2 = CodeBlock { "yyMMdd-HHMMss"; }
format = DateTime.Format(dateTime=now, format=code_block_2)
string_2 = StringInput("_Warnings.json")
add = format + string_2
add_2 = string + add

# group: Create a JSON and save to path
byKeysAndValues = JsonObject.ByKeysAndValues(keys=keys@L2, values=values@L2, Nesting=true, Option="None")
toJsonFile = JsonData.Utilities.Write.ToJsonFile(jsonObjects=byKeysAndValues, filepath=add_2)
