# Dynamo graph Views.dyn (Dynamo 2.12.0.5650)
# packages: JsonData 2.0.2

# group: Get all views
code_block = CodeBlock { "Views"; }
byName = Category.ByName(name=code_block)
all_elements_of_category = ElementsOfCategory(Category=byName)

# group: Clean List
code_block_2 = CodeBlock { false; }
clean = List.Clean(list=all_elements_of_category, preserveIndices=code_block_2)

# group: Filter out View Templates
isViewTemplate = View.IsViewTemplate(view=clean)
filterByBoolMask = List.FilterByBoolMask(list=clean, mask=isViewTemplate)

# group: Get all paremeters of placed families
parameters = Element.Parameters(element=filterByBoolMask.in)

# group: Add parameter ID to parameter name
string_from_object = FromObject(object=parameters)
uniqueItems = List.UniqueItems(list=string_from_object@L2)
code_block_3 = CodeBlock { "."; ""; }
replace = String.Replace(string=uniqueItems@L2, searchFor=code_block_3.out0, replaceWith=code_block_3.out1)

# group: Split parameter name from value
string = StringInput(" : ")
split = String.Split(string=replace, separator0=string)
count = List.Count(list=split@@L2)
code_block_4 = CodeBlock { 1; }
eq = count@@L2 == code_block_4
filterByBoolMask_2 = List.FilterByBoolMask(list=split, mask=eq)
code_block_5 = CodeBlock { 0; }
removeItemAtIndex = List.RemoveItemAtIndex(list=filterByBoolMask_2.out@@L2, indices=code_block_5)
getItemAtIndex = List.GetItemAtIndex(list=filterByBoolMask_2.out@@L2, index=code_block_5)

# group: Concatinate additional : splits
code_block_6 = CodeBlock { " - "; }
join = String.Join(separator=code_block_6, string0=removeItemAtIndex@@L2)

# group: Flatten list
code_block_7 = CodeBlock { 1; }
flatten = List.Flatten(list=join, amount=code_block_7)

# group: Remove : from fields
code_block_8 = CodeBlock { ":"; " "; }
replace_2 = String.Replace(string=getItemAtIndex@@L2, searchFor=code_block_8.out0, replaceWith=code_block_8.out1)

groupByKey = List.GroupByKey(list=flatten@L2, keys=replace_2@L2)

# group: Add EID and GUID paramater slots
string_2 = StringInput("GUID")
string_3 = StringInput("EID")
addItemToFront = List.AddItemToFront(item=string_3, list=groupByKey.uniqueKeys@L2)
addItemToFront_2 = List.AddItemToFront(item=string_2, list=addItemToFront@L2)

# group: Concatinate additional : splits
code_block_9 = CodeBlock { " , "; }
join_2 = String.Join(separator=code_block_9, string0=groupByKey.groups@@L2)

# group: Add EID Value for each element
id = Element.Id(element=filterByBoolMask.in)
string_from_object_2 = FromObject(object=id)
addItemToFront_3 = List.AddItemToFront(item=string_from_object_2@L1, list=join_2@@L2)

# group: Add GUID value for each element
uniqueId = Element.UniqueId(element=filterByBoolMask.in)
string_from_object_3 = FromObject(object=uniqueId)
addItemToFront_4 = List.AddItemToFront(item=string_from_object_3@L1, list=addItemToFront_3@@L2)

# group: Create a dictionary, then split out values and keys
byKeysValues = DesignScript.Builtin.Dictionary.ByKeysValues(keys=addItemToFront_2@L2, values=addItemToFront_4@L2)
keys = DesignScript.Builtin.Dictionary.Keys(dictionary=byKeysValues)
values = DesignScript.Builtin.Dictionary.Values(dictionary=byKeysValues)

# group: Name File
string_4 = StringInput("C:\Scratch\_Testing\")
now = DateTime.Now()
code_block_10 = CodeBlock { "yyMMdd-HHMMss_"; }
format = DateTime.Format(dateTime=now, format=code_block_10)
string_5 = StringInput(".json")

add = code_block + string_5

# group (continued): Name File
add_2 = format + add
add_3 = string_4 + add_2

# group: Create a JSON and save to path
byKeysAndValues = JsonObject.ByKeysAndValues(keys=keys@L2, values=values@L2, Nesting=true, Option="None")
toJsonFile = JsonData.Utilities.Write.ToJsonFile(jsonObjects=byKeysAndValues, filepath=add_3)
