# Dynamo graph Sheets.dyn (Dynamo 2.12.0.5650)
# packages: JsonData 2.0.2, archi-lab.net 2022.212.3222

# group: Get all sheets
code_block = CodeBlock { "Sheets"; }
byName = Category.ByName(name=code_block)
all_elements_of_category = ElementsOfCategory(Category=byName)

# group: Get all paremeters of placed families
parameters = Element.Parameters(element=all_elements_of_category)

# group: Add parameter ID to parameter name
id = Parameter.Id(parameter=parameters)
string_from_object = FromObject(object=id)
string_from_object_2 = FromObject(object=parameters)
code_block_2 = CodeBlock { "."; ""; }
replace = String.Replace(string=string_from_object_2@L2, searchFor=code_block_2.out0, replaceWith=code_block_2.out1)
code_block_3 = CodeBlock(x=string_from_object, y=replace) { "("+x+")"+y; }

# group: Get unique items (remove duplicated)
uniqueItems = List.UniqueItems(list=code_block_3@L2)

# group: Split parameter name from value
string = StringInput(" : ")
split = String.Split(string=uniqueItems, separator0=string)
code_block_4 = CodeBlock { 0; }
getItemAtIndex = List.GetItemAtIndex(list=split@@L2, index=code_block_4)
removeItemAtIndex = List.RemoveItemAtIndex(list=split@@L2, indices=code_block_4)

# group: Add EID and GUID paramater slots
string_2 = StringInput("GUID")
string_3 = StringInput("EID")
addItemToFront = List.AddItemToFront(item=string_3, list=getItemAtIndex@L2)
addItemToFront_2 = List.AddItemToFront(item=string_2, list=addItemToFront@L2)

# group: Replace empty lists with a space
code_block_5 = CodeBlock { "-BLANK-"; }
replaceEmptyList = archilab.Lists.Lists.ReplaceEmptyList(list=removeItemAtIndex, replacement=code_block_5)

# group: Concatinate additional : splits
code_block_6 = CodeBlock { " : "; }
join = String.Join(separator=code_block_6, string0=replaceEmptyList@@L2)

# group: Flatten list
code_block_7 = CodeBlock { 1; }
flatten = List.Flatten(list=join, amount=code_block_7)

# group: Add EID Value for each element
id_2 = Element.Id(element=all_elements_of_category)
string_from_object_3 = FromObject(object=id_2)
addItemToFront_3 = List.AddItemToFront(item=string_from_object_3@L1, list=flatten@@L2)

# group: Add GUID value for each element
uniqueId = Element.UniqueId(element=all_elements_of_category)
string_from_object_4 = FromObject(object=uniqueId)
addItemToFront_4 = List.AddItemToFront(item=string_from_object_4@L1, list=addItemToFront_3@@L2)

# group: Create a dictionary, then split out values and keys
byKeysValues = DesignScript.Builtin.Dictionary.ByKeysValues(keys=addItemToFront_2@L2, values=addItemToFront_4@L2)
keys = DesignScript.Builtin.Dictionary.Keys(dictionary=byKeysValues)
values = DesignScript.Builtin.Dictionary.Values(dictionary=byKeysValues)

# group: Name File
string_4 = StringInput("C:\Scratch\_Testing\")
now = DateTime.Now()
code_block_8 = CodeBlock { "yyMMdd-HHMMss"; }
format = DateTime.Format(dateTime=now, format=code_block_8)
string_5 = StringInput("_Sheets.json")
add = format + string_5
add_2 = string_4 + add

# group: Create a JSON and save to path
byKeysAndValues = JsonObject.ByKeysAndValues(keys=keys@L2, values=values@L2, Nesting=true, Option="None")
toJsonFile = JsonData.Utilities.Write.ToJsonFile(jsonObjects=byKeysAndValues, filepath=add_2)
