# Dynamo graph FileData2.dyn (Dynamo 2.12.0.5650)
# packages: Genius Loci 2022.3.31, JsonData 2.0.2, archi-lab.net 2022.212.3222

code_block = CodeBlock { ["Severity","Description"]; }

# group: Get the current document
current = Document.Current()

getWarnings = Warning.GetWarnings(document=current)  # frozen
severity = Warning.Severity(warning=getWarnings)
description = Warning.Description(warning=getWarnings)
list_create = List.Create(item0=severity, item1=description)
transpose = List.Transpose(lists=list_create)

# group: Create a dictionary, then split out values and keys
byKeysValues = DesignScript.Builtin.Dictionary.ByKeysValues(keys=code_block, values=transpose@L2)
keys = DesignScript.Builtin.Dictionary.Keys(dictionary=byKeysValues)
values = DesignScript.Builtin.Dictionary.Values(dictionary=byKeysValues)

# group: Name File
string = StringInput("C:\Scratch\_Testing\")
now = DateTime.Now()
code_block_2 = CodeBlock { "yyMMdd-HHMMss"; }
format = DateTime.Format(dateTime=now, format=code_block_2)
string_2 = StringInput("_Warnings.json")
add = format + string_2
add_2 = string + add

# group: Create a JSON and save to path
byKeysAndValues = JsonObject.ByKeysAndValues(keys=keys@L2, values=values@L2, Nesting=true, Option="None")
toJsonFile = JsonData.Utilities.Write.ToJsonFile(jsonObjects=byKeysAndValues, filepath=add_2)

code_block_3 = CodeBlock()
# ---------- code_block_3.designscript (7 lines) ----------
["GUID",
"Path",
"Name",
"Link Type",
"Status",
"Pinned",
"Workset"];
# ----------------------------------------
filePath = Document.FilePath(document=current)
reportRevitLinks = Custom[ReportRevitLinks](filePath=filePath)  # package Genius Loci; Inspired by Bimorph. Generates a report of all Revit links in the document. Revit links properties are output to facilitate the Revit link model management.
firstItem = List.FirstItem(list=reportRevitLinks.Report@L2)  # frozen
uniqueId = Element.UniqueId(element=firstItem)
code_block_4 = CodeBlock { 6; }
getItemAtIndex = List.GetItemAtIndex(list=reportRevitLinks.Report@L2, index=code_block_4)
code_block_5 = CodeBlock { [1,2,3,4,5]; }
getItemAtIndex_2 = List.GetItemAtIndex(list=reportRevitLinks.Report@L2, index=code_block_5)  # frozen
code_block_6 = CodeBlock { " : "; }
split = String.Split(string=getItemAtIndex_2, separator0=code_block_6)
lastItem = List.LastItem(list=split@@L2)
addItemToFront = List.AddItemToFront(item=getItemAtIndex, list=lastItem@L2, lacing=Shortest)
addItemToFront_2 = List.AddItemToFront(item=uniqueId, list=addItemToFront@L2, lacing=Shortest)

# group: Create a dictionary, then split out values and keys
byKeysValues_2 = DesignScript.Builtin.Dictionary.ByKeysValues(keys=code_block_3, values=addItemToFront_2@L2)
keys_2 = DesignScript.Builtin.Dictionary.Keys(dictionary=byKeysValues_2)
values_2 = DesignScript.Builtin.Dictionary.Values(dictionary=byKeysValues_2)

# group: Name File
string_3 = StringInput("C:\Scratch\_Testing\")
now_2 = DateTime.Now()
code_block_7 = CodeBlock { "yyMMdd-HHMMss"; }
format_2 = DateTime.Format(dateTime=now_2, format=code_block_7)
string_4 = StringInput("_Links.json")
add_3 = format_2 + string_4
add_4 = string_3 + add_3

# group: Create a JSON and save to path
byKeysAndValues_2 = JsonObject.ByKeysAndValues(keys=keys_2@L2, values=values_2@L2, Nesting=true, Option="None")
toJsonFile_2 = JsonData.Utilities.Write.ToJsonFile(jsonObjects=byKeysAndValues_2, filepath=add_4)

getDocuments = archilab.Revit.Selection.Select.GetDocuments()
watch = Watch(getDocuments.Link_Name)
watch_2 = Watch(getDocuments.Link_Path)
watch_3 = Watch(getDocuments.Link_Instance)
watch_4 = Watch(getDocuments.Link_Doc)
