# Dynamo custom node CheckNew.dyf "Deatils_Version_Check" (Dynamo 2.12.0.5650)
# category: TT-D2
# Checks the details in the file vs master database
# packages: JsonData 2.0.2, Rhythm 2022.4.1, DynaWeb 1.0.3

# group: Inputs
CycleIn = Input(CycleIn: var[]..[])
FamilyList = Input(FamilyList: var[]..[])

# group: Increment loop number
code_block = CodeBlock(x=CycleIn) { x+1; }

# group: Get view at loop index
getItemAtIndex = List.GetItemAtIndex(list=FamilyList, index=CycleIn)

# group: Create list of ciew parameters
code_block_2 = CodeBlock { "Match"; }
code_block_3 = CodeBlock { "AirTableID"; "DetailVersion"; "Title on Sheet"; }
getParameterValueByName = Element.GetParameterValueByName(element=getItemAtIndex, parameterName=code_block_3.out0)
name = Family.Name(family=getItemAtIndex)
getParameterValueByName_2 = Element.GetParameterValueByName(element=getItemAtIndex, parameterName=code_block_3.out2)
getParameterValueByName_3 = Element.GetParameterValueByName(element=getItemAtIndex, parameterName=code_block_3.out1)
uniqueId = Element.UniqueId(element=getItemAtIndex)
list_create = List.Create(item0=code_block_2, item1=getParameterValueByName, item2=name, item3=getParameterValueByName_2, item4=getParameterValueByName_3, item5=uniqueId)

# group: Lookup data from airtable
code_block_4 = CodeBlock { "https://api.airtable.com/v0/appGclKMDPqNIGhxi/DetailList/"; }
code_block_5 = CodeBlock(base=code_block_4, ID=getParameterValueByName)
# ---------- code_block_5.designscript (2 lines) ----------
base+
ID;
# ----------------------------------------
byUrl = DynaWeb.WebRequest.ByUrl(url=code_block_5)
string = StringInput("GET")
setMethod = DynaWeb.WebRequest.SetMethod(webRequest=byUrl, method=string)
string_2 = StringInput("Authorization")
token_here_without_bearer = StringInput("keyE2u3lzrXh3CUiP")
code_block_6 = CodeBlock(token=token_here_without_bearer)
# ---------- code_block_6.designscript (2 lines) ----------
"Bearer "+
token;
# ----------------------------------------
addHeader = DynaWeb.WebRequest.AddHeader(webRequest=setMethod, name=string_2, value=code_block_6)
execute = DynaWeb.WebRequest.Execute(request=addHeader)
content = DynaWeb.WebResponse.Content(webResponse=execute)
string_3 = JsonData.Utilities.Parse.String(jsonString=content)
toDictionary = JsonData.Elements.JsonObject.ToDictionary(jsonObject=string_3)
components = DesignScript.Builtin.Dictionary.Components(dictionary=toDictionary)
firstItem = List.FirstItem(list=components.values)
code_block_7 = CodeBlock()
# ---------- code_block_7.designscript (4 lines) ----------
["View Name",
"View Title on Sheet",
"Version Number",
"ViewID"];
# ----------------------------------------
valueAtKey = DesignScript.Builtin.Dictionary.ValueAtKey(dictionary=firstItem, key=code_block_7, lacing=CrossProduct)

# group: Format all data
ʳʰʸᵗʰᵐ_system = Rhythm.Helpers.System.CurrentUserTempFolder()
string_4 = StringInput("DetailsCheck.xlsx")
code_block_8 = CodeBlock(path=ʳʰʸᵗʰᵐ_system, File=string_4) { path+ File; }
code_block_9 = CodeBlock { "Results"; }
code_block_10 = CodeBlock { 0; }
addItemToFront = List.AddItemToFront(item=list_create, list=valueAtKey)
flatten = List.Flatten(list=addItemToFront)
code_block_11 = CodeBlock { 0; }
code_block_12 = CodeBlock { 4; 8; }
getItemAtIndex_2 = List.GetItemAtIndex(list=flatten, index=code_block_12.out0)
getItemAtIndex_3 = List.GetItemAtIndex(list=flatten, index=code_block_12.out1)
eq = getItemAtIndex_2 == getItemAtIndex_3
code_block_13 = CodeBlock { "Yes"; "No"; }
if_ = RefactoredIf(test=eq, true=code_block_13.out0, false=code_block_13.out1)
replaceItemAtIndex = List.ReplaceItemAtIndex(list=flatten, index=code_block_11, item=if_)
list_create_2 = List.Create(item0=replaceItemAtIndex)
code_block_14 = CodeBlock { false; }

# group: Export Results
exportToExcel = Data.ExportToExcel(filePath=code_block_8, sheetName=code_block_9, startRow=code_block, startColumn=code_block_10, data=list_create_2, overWrite=code_block_14)

# group: Outputs
Result = Output(exportToExcel)
CycleOut = Output(code_block)
