# Dynamo graph Final_Check Project.dyn "_New-31-Check-All" (Dynamo 2.12.0.5650)
# packages: Rhythm 2022.4.1

# group: Get all views
code_block = CodeBlock { "Views"; }
byName = Category.ByName(name=code_block)

# group: Clear temp Excel file
ʳʰʸᵗʰᵐ_system = Rhythm.Helpers.System.CurrentUserTempFolder()
string = StringInput("DetailsCheck.xlsx")
code_block_2 = CodeBlock(path=ʳʰʸᵗʰᵐ_system, File=string) { path+ File; }
code_block_3 = CodeBlock { "Results"; 0; true; }
code_block_4 = CodeBlock()
# ---------- code_block_4.designscript (10 lines) ----------
["Matching",
"AirTableID (Lookup)",
"View Name (Revit)",
"Title On Sheet (Revit)",
"Version Number (Revit)",
"GUID (Revit)",
"View Name (AirTable)",
"Title on Sheet (AirTable)",
"Version Number (AirTable)",
"GUID (AirTable)"];
# ----------------------------------------
list_create = List.Create(item0=code_block_4)
exportToExcel = Data.ExportToExcel(filePath=code_block_2, sheetName=code_block_3.out0, startRow=code_block_3.out1, startColumn=code_block_3.out1, data=list_create, overWrite=code_block_3.out2)

# group: Wait
list_create_2 = List.Create(item0=byName, item1=exportToExcel)
firstItem = List.FirstItem(list=list_create_2)

# group: Filter to drafting views
all_elements_of_category = ElementsOfCategory(Category=firstItem)
string_from_object = FromObject(object=all_elements_of_category)
code_block_5 = CodeBlock { "DraftingView"; }
startsWith = String.StartsWith(string=string_from_object, searchFor=code_block_5)
filterByBoolMask = List.FilterByBoolMask(list=all_elements_of_category, mask=startsWith)

# group: Filter drafting views with no Typical ID
code_block_6 = CodeBlock { "AirTableID"; }
getParameterValueByName = Element.GetParameterValueByName(element=filterByBoolMask.in, parameterName=code_block_6)
code_block_7 = CodeBlock { ""; }
eq = getParameterValueByName == code_block_7
not_ = Not(x=eq)
filterByBoolMask_2 = List.FilterByBoolMask(list=filterByBoolMask.in, mask=not_)

# group: Check version for all views
deatils_Version_Check = Custom[Deatils_Version_Check](FamilyList=filterByBoolMask_2.in)  # Checks the details in the file vs master database; unwired: CycleIn

# group: Loop
code_block_8 = CodeBlock { 0; }
count = List.Count(list=filterByBoolMask_2.in)
ne = _ != count  # unwired: x
loopWhile = LoopWhile(initialValue=code_block_8, continueWhile=ne, loopBody=deatils_Version_Check.CycleOut)
