# Dynamo graph Final_Update Revit.dyn "_New-23-Update Version" (Dynamo 2.12.0.5650)
# packages: Rhythm 2022.4.1

# group: Get all views
code_block = CodeBlock { "Views"; }
byName = Category.ByName(name=code_block)
all_elements_of_category = ElementsOfCategory(Category=byName)

# group: Filter out views with no AirTableID
code_block_2 = CodeBlock { "AirTableID"; }
getParameterValueByName = Element.GetParameterValueByName(element=all_elements_of_category, parameterName=code_block_2)
code_block_3 = CodeBlock { ""; }
eq = getParameterValueByName == code_block_3
filterByBoolMask = List.FilterByBoolMask(list=all_elements_of_category, mask=eq)
filterByBoolMask_2 = List.FilterByBoolMask(list=getParameterValueByName, mask=eq)

# group: Create counter file
code_block_4 = CodeBlock { ""; }
currentUserTempFolder = Rhythm.Helpers.System.CurrentUserTempFolder()
string = StringInput("tracker.txt")
code_block_5 = CodeBlock(path=currentUserTempFolder, File=string) { path+ File; }
code_block_6 = CodeBlock { 0; }
exportCSV = Data.ExportCSV(filePath=code_block_5, data=code_block_6)
list_create = List.Create(item0=code_block_4, item1=exportCSV)
firstItem = List.FirstItem(list=list_create)

# group: AirTable data collection
code_block_7 = CodeBlock { "https://api.airtable.com/v0/appGclKMDPqNIGhxi/DetailList"; }
code_block_8 = CodeBlock { "?view=Overview"; }
token_here_without_bearer = StringInput("keyE2u3lzrXh3CUiP")

# group: Clear temp Excel file
ʳʰʸᵗʰᵐ_system = Rhythm.Helpers.System.CurrentUserTempFolder()
string_2 = StringInput("List.xlsx")
code_block_9 = CodeBlock(path=ʳʰʸᵗʰᵐ_system, File=string_2) { path+ File; }
code_block_10 = CodeBlock { "Export"; 0; ""; true; }
exportToExcel = Data.ExportToExcel(filePath=code_block_9, sheetName=code_block_10.out0, startRow=code_block_10.out1, startColumn=code_block_10.out1, data=code_block_10.out2, overWrite=code_block_10.out3)
list_create_2 = List.Create(item0=code_block_9, item1=exportToExcel)
deconstruct = List.Deconstruct(list=list_create_2)
firstItem_2 = List.FirstItem(list=deconstruct.first)

# group: AirTable data collection
get_airtable_data = Custom[Get AirTable Data](BaseID=code_block_7, Option=code_block_8, Token=token_here_without_bearer, XlsPath=firstItem_2)  # Grabs data from inputed location and outputs the pagnation id for the next section. For use with loop function to pull fill records list.; unwired: Pagnation

# group: Loop to get all AirTable Date
code_block_11 = CodeBlock { null; }
ne = _ != code_block_11  # unwired: x
loopWhile = LoopWhile(initialValue=firstItem, continueWhile=ne, loopBody=get_airtable_data.Pagnation)

# group: Import data from temp Excel file
currentUserTempFolder_2 = Rhythm.Helpers.System.CurrentUserTempFolder()
string_3 = StringInput("List.xlsx")
code_block_12 = CodeBlock(path=currentUserTempFolder_2, File=string_3) { path+ File; }
list_create_3 = List.Create(item0=code_block_12, item1=loopWhile)
firstItem_3 = List.FirstItem(list=list_create_3)
file_from_path = FileObject(path=firstItem_3)
code_block_13 = CodeBlock { "Export"; false; }
importExcel = Data.ImportExcel(file=file_from_path, sheetName=code_block_13.out0, showExcel=code_block_13.out1)

# group: Get version number from downloaded list
code_block_14 = CodeBlock { 4; }
getItemAtIndex = List.GetItemAtIndex(list=importExcel@L2, index=code_block_14)

# group: Get AirTableID from downloaded list
code_block_15 = CodeBlock { 0; }
getItemAtIndex_2 = List.GetItemAtIndex(list=importExcel@L2, index=code_block_15)

# group: Find the index from the downloaded list matching the ID in the view
indexOf = List.IndexOf(list=getItemAtIndex_2, element=filterByBoolMask_2.out)

# group: Get the version number from the downloaded list matching the index
getItemAtIndex_3 = List.GetItemAtIndex(list=getItemAtIndex, index=indexOf)

# group: Update the detail version parameter in the view
code_block_16 = CodeBlock { "DetailVersion"; }
setParameterByName = Element.SetParameterByName(element=filterByBoolMask.out, parameterName=code_block_16, value=getItemAtIndex_3)
