# Dynamo custom node GetNew.dyf "AirTable_REST_API_Loop" (Dynamo 2.12.0.5650)
# category: TT-D2.API
# Grabs data from inputed location and outputs the pagnation id for the next section. For use with loop function to pull fill records list.
# packages: JsonData 2.0.2, DynaWeb 1.0.3, Rhythm 2022.4.1

# group: Inputs
XlsPath = Input(XlsPath: var[])
BaseID = Input(BaseID: var[])
Option = Input(Option: var[])
Pagination = Input(Pagination: var[])
Token = Input(Token: var[])

# group: Add loop to tracker
currentUserTempFolder = Rhythm.Helpers.System.CurrentUserTempFolder()
string = StringInput("tracker.txt")
code_block = CodeBlock(path=currentUserTempFolder, File=string) { path+ File; }
importCSV = Data.ImportCSV(filePath=code_block)
flatten = List.Flatten(list=importCSV)
firstItem = List.FirstItem(list=flatten)
code_block_2 = CodeBlock { 0; }
eq = firstItem == code_block_2
code_block_3 = CodeBlock(x=firstItem) { x * 100; }
if_ = RefactoredIf(test=eq, true=firstItem, false=code_block_3)
code_block_4 = CodeBlock(x=firstItem) { x+1; }
exportCSV = Data.ExportCSV(filePath=code_block, data=code_block_4)

# group: Get Data
code_block_5 = CodeBlock(base=BaseID, options=Option, pagination=Pagination)
# ---------- code_block_5.designscript (4 lines) ----------
base+
options+
"&offset="+
pagination;
# ----------------------------------------
byUrl = DynaWeb.WebRequest.ByUrl(url=code_block_5, lacing=Shortest)
string_2 = StringInput("GET")
setMethod = DynaWeb.WebRequest.SetMethod(webRequest=byUrl, method=string_2, lacing=Shortest)
string_3 = StringInput("Authorization")
code_block_6 = CodeBlock(token=Token)
# ---------- code_block_6.designscript (2 lines) ----------
"Bearer "+
token;
# ----------------------------------------
addHeader = DynaWeb.WebRequest.AddHeader(webRequest=setMethod, name=string_3, value=code_block_6, lacing=Shortest)
execute = DynaWeb.WebRequest.Execute(request=addHeader, lacing=Shortest)
content = DynaWeb.WebResponse.Content(webResponse=execute, lacing=Shortest)

# group: Parse Data
string_4 = JsonData.Utilities.Parse.String(jsonString=content)
toDictionary = JsonData.Elements.JsonObject.ToDictionary(jsonObject=string_4)
components = DesignScript.Builtin.Dictionary.Components(dictionary=toDictionary)
code_block_7 = CodeBlock { 0; }
code_block_8 = CodeBlock { "fields"; }

firstItem_2 = List.FirstItem(list=components.values)

# group (continued): Parse Data
getItemAtIndex = List.GetItemAtIndex(list=firstItem_2, index=code_block_7)
toDictionary_2 = JsonData.Elements.JsonObject.ToDictionary(jsonObject=getItemAtIndex)
valueAtKey = DesignScript.Builtin.Dictionary.ValueAtKey(dictionary=toDictionary_2, key=code_block_8)

# group: Extract Data
code_block_9 = CodeBlock { "id"; }
valueAtKey_2 = DesignScript.Builtin.Dictionary.ValueAtKey(dictionary=toDictionary_2, key=code_block_9, lacing=CrossProduct)
code_block_10 = CodeBlock()
# ---------- code_block_10.designscript (4 lines) ----------
["ViewID",
"View Name",
"View Title on Sheet",
"Version Number"];
# ----------------------------------------
valueAtKey_3 = DesignScript.Builtin.Dictionary.ValueAtKey(dictionary=valueAtKey, key=code_block_10, lacing=CrossProduct)
addItemToFront = List.AddItemToFront(item=valueAtKey_2, list=valueAtKey_3, lacing=Shortest)

# group: Write Excel
code_block_11 = CodeBlock { "Export"; 0; false; }
exportToExcel = Data.ExportToExcel(filePath=XlsPath, sheetName=code_block_11.out0, startRow=if_, startColumn=code_block_11.out1, data=addItemToFront, overWrite=code_block_11.out2)

# group: Get Pagnation
code_block_12 = CodeBlock { 1; }
getItemAtIndex_2 = List.GetItemAtIndex(list=firstItem_2, index=code_block_12)

# group: Outputs
Fields = Output(exportToExcel)
Pagnation = Output(getItemAtIndex_2)
Counter = Output(exportCSV)
