# Dynamo custom node PostNew.dyf (Dynamo 2.12.0.5650)
# category: DBWA
# packages: DynaWeb 1.0.3, JsonData 2.0.2

# group: Inputs
FamilyList = Input(FamilyList: var[]..[])
CycleIn = Input(CycleIn: var[]..[])
BaseID = Input(BaseID: var[]..[])
TableName = Input(TableName: var[]..[])
APIKey = Input(APIKey: var[]..[])

# group: Get the item at the loop index number
getItemAtIndex = List.GetItemAtIndex(list=FamilyList, index=CycleIn)

# group: API URL
code_block = CodeBlock { "https://api.airtable.com/v0/"; }
code_block_2 = CodeBlock(airtableUrl=code_block, baseId=BaseID, tableName=TableName)
# ---------- code_block_2.designscript (3 lines) ----------
airtableUrl+
baseId+"/"+
tableName;
# ----------------------------------------

# group: Create request
byUrl = DynaWeb.WebRequest.ByUrl(url=code_block_2)

# group: Add header with auth
code_block_3 = CodeBlock(appiKey=APIKey) { "Authorization"; "Bearer "+appiKey; }
addHeader = DynaWeb.WebRequest.AddHeader(webRequest=byUrl, name=code_block_3.out0, value=code_block_3.out1)

# group: Set request method
code_block_4 = CodeBlock { "POST"; }
setMethod = DynaWeb.WebRequest.SetMethod(webRequest=addHeader, method=code_block_4)

# group: get parameters to push and group them
name = Element.Name(element=getItemAtIndex)
uniqueId = Element.UniqueId(element=getItemAtIndex)
code_block_5 = CodeBlock { "Title on Sheet"; }
getParameterValueByName = Element.GetParameterValueByName(element=getItemAtIndex, parameterName=code_block_5)
list_create = List.Create(item0=name, item1=uniqueId, item2=getParameterValueByName)

# group: Convert to JSON
code_block_6 = CodeBlock()
# ---------- code_block_6.designscript (3 lines) ----------
["records.fields.View Name",
"records.fields.ViewID",
"records.fields.View Title on Sheet"];
# ----------------------------------------
byKeysAndValues = JsonObject.ByKeysAndValues(keys=code_block_6, values=list_create, Nesting=true, Option="None")

# group: Reformat to desired state for API nodes
jsonToString = JsonData.Utilities.Parse.JsonToString(jsonObjects=byKeysAndValues)
code_block_7 = CodeBlock { "\r\n"; }
split = String.Split(string=jsonToString, separator0=code_block_7)
trimWhitespace = String.TrimWhitespace(string=split)
code_block_8 = CodeBlock { 1; }
string = StringInput("\"records\":[{")
replaceItemAtIndex = List.ReplaceItemAtIndex(list=trimWhitespace, index=code_block_8, item=string)
count = List.Count(list=replaceItemAtIndex)
code_block_9 = CodeBlock(x=count) { x-1; }
string_2 = StringInput("]}")
replaceItemAtIndex_2 = List.ReplaceItemAtIndex(list=replaceItemAtIndex, index=code_block_9, item=string_2)
concat = String.Concat(string0=replaceItemAtIndex_2)
firstItem = List.FirstItem(list=concat)

# group: Add data to request
string_3 = StringInput("application/json")
string_4 = StringInput("RequestBody")
addParameter = DynaWeb.WebRequest.AddParameter(webRequest=setMethod, name=string_3, value=firstItem, parameterType=string_4, lacing=Shortest)

# group: Execute request
execute = DynaWeb.WebRequest.Execute(request=addParameter)

# group: Monitor responce
content = DynaWeb.WebResponse.Content(webResponse=execute)

# group: Get AirTable ID
code_block_10 = CodeBlock { 19; 17; }
substring = String.Substring(string=content, startIndex=code_block_10.out0, length=code_block_10.out1)

# group: Set AirTable ID parameter in view
code_block_11 = CodeBlock { "AirTableID"; }
setParameterByName = Element.SetParameterByName(element=getItemAtIndex, parameterName=code_block_11, value=substring)

# group: Increment loop
# note: Counter created for tracking loop
code_block_12 = CodeBlock(x=CycleIn) { x+1; }

# group: Outputs
Result = Output(setParameterByName)
CycleOut = Output(code_block_12)
