# Dynamo graph _New-00-NameViews.dyn (Dynamo 2.12.0.5650)

# group: Select all views
code_block = CodeBlock { "Views"; }
byName = Category.ByName(name=code_block)
all_elements_of_category = ElementsOfCategory(Category=byName)

# group: Create numbered name for each view
code_block_2 = CodeBlock { "Detail_"; }
count = List.Count(list=all_elements_of_category)
code_block_3 = CodeBlock(x=count) { 01..x; }
string_from_object = FromObject(object=code_block_3)
code_block_4 = CodeBlock { 3; "0"; }
padLeft = String.PadLeft(string=string_from_object, newLength=code_block_4.out0, padChars=code_block_4.out1)
add = code_block_2 + padLeft

# group: Rename views
code_block_5 = CodeBlock { "View Name"; }
setParameterByName = Element.SetParameterByName(element=all_elements_of_category, parameterName=code_block_5, value=add)
