# Dynamo graph _New-10-Extract Data-Single.dyn (Dynamo 2.12.0.5650)
# packages: JsonData 2.0.2, DynaWeb 1.0.3

# group: Get all views
code_block = CodeBlock { "Views"; }
byName = Category.ByName(name=code_block)
all_elements_of_category = ElementsOfCategory(Category=byName)

# group: Get just the first view
firstItem = List.FirstItem(list=all_elements_of_category)

# group: Details to access API
# note: Base ID is found in the API documentation.
# APIKey is in the user settings.
# Table name is the table name (the tab not the top title).
code_block_2 = CodeBlock { "appGclKMDPqNIGhxi"; "DetailList"; "keyE2u3lzrXh3CUiP"; }

# group: API URL
code_block_3 = CodeBlock { "https://api.airtable.com/v0/"; }
# note: AirTable REST URL
code_block_4 = CodeBlock(airtableUrl=code_block_3, baseId=code_block_2.out0, tableName=code_block_2.out1)
# ---------- code_block_4.designscript (3 lines) ----------
airtableUrl+
baseId+"/"+
tableName;
# ----------------------------------------

# group: Create request
byUrl = DynaWeb.WebRequest.ByUrl(url=code_block_4)

# group: Add header with auth
code_block_5 = CodeBlock(appiKey=code_block_2.out2) { "Authorization"; "Bearer "+appiKey; }
addHeader = DynaWeb.WebRequest.AddHeader(webRequest=byUrl, name=code_block_5.out0, value=code_block_5.out1)

# group: Set request method
code_block_6 = CodeBlock { "POST"; }
setMethod = DynaWeb.WebRequest.SetMethod(webRequest=addHeader, method=code_block_6)

# group: get view name, GUID, and Title on Sheet, to push, and group them
name = Element.Name(element=firstItem)
uniqueId = Element.UniqueId(element=firstItem)
code_block_7 = CodeBlock { "Title on Sheet"; }
getParameterValueByName = Element.GetParameterValueByName(element=firstItem, parameterName=code_block_7)
list_create = List.Create(item0=name, item1=uniqueId, item2=getParameterValueByName)

# group: Convert to JSON
code_block_8 = CodeBlock()
# ---------- code_block_8.designscript (3 lines) ----------
["records.fields.View Name",
"records.fields.ViewID",
"records.fields.View Title on Sheet"];
# ----------------------------------------
# note: "records.fields." is for grouping
# "View Name" (etc...) are the AirTable column names
byKeysAndValues = JsonObject.ByKeysAndValues(keys=code_block_8, values=list_create, Nesting=true, Option="None")

# group: Reformat to desired state for API nodes
jsonToString = JsonData.Utilities.Parse.JsonToString(jsonObjects=byKeysAndValues)
code_block_9 = CodeBlock { "\r\n"; }
split = String.Split(string=jsonToString, separator0=code_block_9)
trimWhitespace = String.TrimWhitespace(string=split)
code_block_10 = CodeBlock { 1; }
string = StringInput("\"records\":[{")
replaceItemAtIndex = List.ReplaceItemAtIndex(list=trimWhitespace, index=code_block_10, item=string)
# note: All of this is done to reformat the request for DynaWeb. See DynaWeb examples for more info
count = List.Count(list=replaceItemAtIndex)
code_block_11 = CodeBlock(x=count) { x-1; }
string_2 = StringInput("]}")
replaceItemAtIndex_2 = List.ReplaceItemAtIndex(list=replaceItemAtIndex, index=code_block_11, item=string_2)
concat = String.Concat(string0=replaceItemAtIndex_2)
firstItem_2 = List.FirstItem(list=concat)

# group: Add data to request
# note: POST since these are new
string_3 = StringInput("application/json")
string_4 = StringInput("RequestBody")
addParameter = DynaWeb.WebRequest.AddParameter(webRequest=setMethod, name=string_3, value=firstItem_2, parameterType=string_4, lacing=Shortest)

# group: Execute request
execute = DynaWeb.WebRequest.Execute(request=addParameter)

# group: Monitor responce
content = DynaWeb.WebResponse.Content(webResponse=execute)

# group: Get AirTable ID
code_block_12 = CodeBlock { 19; 17; }
substring = String.Substring(string=content, startIndex=code_block_12.out0, length=code_block_12.out1)

# group: Set AirTable ID parameter in view
code_block_13 = CodeBlock { "AirTableID"; }
setParameterByName = Element.SetParameterByName(element=firstItem, parameterName=code_block_13, value=substring)
