# Dynamo graph _New-20-099.dyn (Dynamo 2.12.0.5650)
# packages: Rhythm 2022.4.1, DynaWeb 1.0.3, JsonData 2.0.2

# group: Clear temp Excel file
ʳʰʸᵗʰᵐ_system = Rhythm.Helpers.System.CurrentUserTempFolder()
string = StringInput("List.xlsx")
code_block = CodeBlock(path=ʳʰʸᵗʰᵐ_system, File=string) { path+ File; }
code_block_2 = CodeBlock { "Export"; 0; ""; true; }
exportToExcel = Data.ExportToExcel(filePath=code_block, sheetName=code_block_2.out0, startRow=code_block_2.out1, startColumn=code_block_2.out1, data=code_block_2.out2, overWrite=code_block_2.out3)
list_create = List.Create(item0=code_block, item1=exportToExcel)
deconstruct = List.Deconstruct(list=list_create)
firstItem = List.FirstItem(list=deconstruct.first)

# group: AirTable data collection
code_block_3 = CodeBlock { "https://api.airtable.com/v0/appGclKMDPqNIGhxi/DetailList"; }
code_block_4 = CodeBlock { "?view=Overview"; }
token_here_without_bearer = StringInput("keyE2u3lzrXh3CUiP")

# group: Get Data
code_block_5 = CodeBlock(base=code_block_3, options=code_block_4)
# ---------- code_block_5.designscript (2 lines) ----------
base+
options;
# ----------------------------------------
byUrl = DynaWeb.WebRequest.ByUrl(url=code_block_5, lacing=Shortest)
string_2 = StringInput("GET")
setMethod = DynaWeb.WebRequest.SetMethod(webRequest=byUrl, method=string_2, lacing=Shortest)
string_3 = StringInput("Authorization")
code_block_6 = CodeBlock(token=token_here_without_bearer)
# ---------- code_block_6.designscript (2 lines) ----------
"Bearer "+
token;
# ----------------------------------------
addHeader = DynaWeb.WebRequest.AddHeader(webRequest=setMethod, name=string_3, value=code_block_6, lacing=Shortest)
execute = DynaWeb.WebRequest.Execute(request=addHeader, lacing=Shortest)
content = DynaWeb.WebResponse.Content(webResponse=execute, lacing=Shortest)

# group: Parse Data
string_4 = JsonData.Utilities.Parse.String(jsonString=content)
toDictionary = JsonData.Elements.JsonObject.ToDictionary(jsonObject=string_4)
components = DesignScript.Builtin.Dictionary.Components(dictionary=toDictionary)
toDictionary_2 = JsonData.Elements.JsonObject.ToDictionary(jsonObject=components.values)
code_block_7 = CodeBlock { "fields"; }
valueAtKey = DesignScript.Builtin.Dictionary.ValueAtKey(dictionary=toDictionary_2, key=code_block_7)

# group: Extract Data
code_block_8 = CodeBlock { "id"; }
valueAtKey_2 = DesignScript.Builtin.Dictionary.ValueAtKey(dictionary=toDictionary_2, key=code_block_8, lacing=CrossProduct)
code_block_9 = CodeBlock()
# ---------- code_block_9.designscript (4 lines) ----------
["ViewID",
"View Name",
"View Title on Sheet",
"Version Number"];
# ----------------------------------------
valueAtKey_3 = DesignScript.Builtin.Dictionary.ValueAtKey(dictionary=valueAtKey, key=code_block_9, lacing=CrossProduct)
addItemToFront = List.AddItemToFront(item=valueAtKey_2, list=valueAtKey_3, lacing=Shortest)

# group: Reformat
code_block_10 = CodeBlock { 1; }
flatten = List.Flatten(list=addItemToFront, amount=code_block_10)
transpose = List.Transpose(lists=flatten)

# group: Write Excel
code_block_11 = CodeBlock { "Export"; 0; false; }
exportToExcel_2 = Data.ExportToExcel(filePath=firstItem, sheetName=code_block_11.out0, startRow=code_block_11.out1, startColumn=code_block_11.out1, data=transpose, overWrite=code_block_11.out2)
