# Dynamo graph Final_Push to Airtable.dyn "_New-11-Extract Data" (Dynamo 2.12.0.5650)

# group: Collect views
code_block = CodeBlock { "Views"; }
byName = Category.ByName(name=code_block)
all_elements_of_category = ElementsOfCategory(Category=byName)

# group: Filter out any views previously uploaded
code_block_2 = CodeBlock { "AirTableID"; }
getParameterValueByName = Element.GetParameterValueByName(element=all_elements_of_category, parameterName=code_block_2)
code_block_3 = CodeBlock { ""; }
eq = getParameterValueByName == code_block_3
filterByBoolMask = List.FilterByBoolMask(list=all_elements_of_category, mask=eq)

# group: API Access info
code_block_4 = CodeBlock { "appGclKMDPqNIGhxi"; "DetailList"; "keyE2u3lzrXh3CUiP"; }

# group: POST to AirTable
postNew = Custom[PostNew](FamilyList=filterByBoolMask.in, BaseID=code_block_4.out0, TableName=code_block_4.out1, APIKey=code_block_4.out2)  # unwired: CycleIn

# group: Loop for each item in the list
code_block_5 = CodeBlock { 0; }
count = List.Count(list=filterByBoolMask.in)
lt = _ < count  # unwired: x
loopWhile = LoopWhile(initialValue=code_block_5, continueWhile=lt, loopBody=postNew.CycleOut)
