# Dynamo graph _New-22-Get-All.dyn (Dynamo 2.12.0.5650)
# packages: Rhythm 2022.4.1

# group: Create counter file
code_block = CodeBlock { ""; }
currentUserTempFolder = Rhythm.Helpers.System.CurrentUserTempFolder()
string = StringInput("tracker.txt")
code_block_2 = CodeBlock(path=currentUserTempFolder, File=string) { path+ File; }
code_block_3 = CodeBlock { 0; }
exportCSV = Data.ExportCSV(filePath=code_block_2, data=code_block_3)
list_create = List.Create(item0=code_block, item1=exportCSV)
firstItem = List.FirstItem(list=list_create)

# group: AirTable data collection
code_block_4 = CodeBlock { "https://api.airtable.com/v0/appGclKMDPqNIGhxi/DetailList"; }
code_block_5 = CodeBlock { "?view=Overview"; }
token_here_without_bearer = StringInput("keyE2u3lzrXh3CUiP")

# group: Clear temp Excel file
ʳʰʸᵗʰᵐ_system = Rhythm.Helpers.System.CurrentUserTempFolder()
string_2 = StringInput("List.xlsx")
code_block_6 = CodeBlock(path=ʳʰʸᵗʰᵐ_system, File=string_2) { path+ File; }
code_block_7 = CodeBlock { "Export"; 0; ""; true; }
exportToExcel = Data.ExportToExcel(filePath=code_block_6, sheetName=code_block_7.out0, startRow=code_block_7.out1, startColumn=code_block_7.out1, data=code_block_7.out2, overWrite=code_block_7.out3)
list_create_2 = List.Create(item0=code_block_6, item1=exportToExcel)
deconstruct = List.Deconstruct(list=list_create_2)
firstItem_2 = List.FirstItem(list=deconstruct.first)

# group: AirTable data collection
get_airtable_data = Custom[Get AirTable Data](BaseID=code_block_4, Option=code_block_5, Token=token_here_without_bearer, XlsPath=firstItem_2)  # Grabs data from inputed location and outputs the pagnation id for the next section. For use with loop function to pull fill records list.; unwired: Pagnation

# group: Loop to get all AirTable Date
code_block_8 = CodeBlock { null; }
ne = _ != code_block_8  # unwired: x
loopWhile = LoopWhile(initialValue=firstItem, continueWhile=ne, loopBody=get_airtable_data.Pagnation)

# group: Import data from temp Excel file
currentUserTempFolder_2 = Rhythm.Helpers.System.CurrentUserTempFolder()
string_3 = StringInput("List.xlsx")
code_block_9 = CodeBlock(path=currentUserTempFolder_2, File=string_3) { path+ File; }
list_create_3 = List.Create(item0=code_block_9, item1=loopWhile)
firstItem_3 = List.FirstItem(list=list_create_3)
file_from_path = FileObject(path=firstItem_3)
code_block_10 = CodeBlock { "Export"; true; }
importExcel = Data.ImportExcel(file=file_from_path, sheetName=code_block_10.out0, showExcel=code_block_10.out1)
