# Dynamo graph _New-30-Check-Single.dyn (Dynamo 2.12.0.5650)
# packages: Rhythm 2022.4.1, JsonData 2.0.2, DynaWeb 1.0.3

# group: Get all views
code_block = CodeBlock { "Views"; }
byName = Category.ByName(name=code_block)

# group: Clear temp Excel file
ʳʰʸᵗʰᵐ_system = Rhythm.Helpers.System.CurrentUserTempFolder()
string = StringInput("DetailsCheck.xlsx")
code_block_2 = CodeBlock(path=ʳʰʸᵗʰᵐ_system, File=string) { path+ File; }
code_block_3 = CodeBlock { "Results"; 0; true; }
code_block_4 = CodeBlock()
# ---------- code_block_4.designscript (10 lines) ----------
["Matching",
"AirTableID (Lookup)",
"View Name (Revit)",
"Title On Sheet (Revit)",
"Version Number (Revit)",
"GUID (Revit)",
"View Name (AirTable)",
"Title on Sheet (AirTable)",
"Version Number (AirTable)",
"GUID (AirTable)"];
# ----------------------------------------
list_create = List.Create(item0=code_block_4)
exportToExcel = Data.ExportToExcel(filePath=code_block_2, sheetName=code_block_3.out0, startRow=code_block_3.out1, startColumn=code_block_3.out1, data=list_create, overWrite=code_block_3.out2)

# group: Wait
list_create_2 = List.Create(item0=byName, item1=exportToExcel)
firstItem = List.FirstItem(list=list_create_2)

# group: Filter down to drafting views
all_elements_of_category = ElementsOfCategory(Category=firstItem)
string_from_object = FromObject(obj=all_elements_of_category)
code_block_5 = CodeBlock { "DraftingView"; }
startsWith = String.StartsWith(string=string_from_object, searchFor=code_block_5)
filterByBoolMask = List.FilterByBoolMask(list=all_elements_of_category, mask=startsWith)

# group: Filter out drafting views with no AirTable ID
code_block_6 = CodeBlock { "AirTableID"; }
getParameterValueByName = Element.GetParameterValueByName(element=filterByBoolMask.in, parameterName=code_block_6)
code_block_7 = CodeBlock { ""; }
eq = getParameterValueByName == code_block_7
not_ = Not(x=eq)
filterByBoolMask_2 = List.FilterByBoolMask(list=filterByBoolMask.in, mask=not_)

# group: get only first view
code_block_8 = CodeBlock { 0; }
getItemAtIndex = List.GetItemAtIndex(list=filterByBoolMask_2.in, index=code_block_8)

# group: Extract view data and add to list
code_block_9 = CodeBlock { "Match"; }
code_block_10 = CodeBlock { "AirTableID"; "DetailVersion"; "Title on Sheet"; }
getParameterValueByName_2 = Element.GetParameterValueByName(element=getItemAtIndex, parameterName=code_block_10.out0)
name = Family.Name(family=getItemAtIndex)
getParameterValueByName_3 = Element.GetParameterValueByName(element=getItemAtIndex, parameterName=code_block_10.out2)
getParameterValueByName_4 = Element.GetParameterValueByName(element=getItemAtIndex, parameterName=code_block_10.out1)
uniqueId = Element.UniqueId(element=getItemAtIndex)
list_create_3 = List.Create(item0=code_block_9, item1=getParameterValueByName_2, item2=name, item3=getParameterValueByName_3, item4=getParameterValueByName_4, item5=uniqueId)

# group: API URL and key
code_block_11 = CodeBlock { "https://api.airtable.com/v0/appGclKMDPqNIGhxi/DetailList/"; }
token_here_without_bearer = StringInput("keyE2u3lzrXh3CUiP")

# group: Lookup master data
code_block_12 = CodeBlock(base=code_block_11, ID=getParameterValueByName_2)
# ---------- code_block_12.designscript (2 lines) ----------
base+
ID;
# ----------------------------------------
byUrl = DynaWeb.WebRequest.ByUrl(url=code_block_12)
string_2 = StringInput("GET")
setMethod = DynaWeb.WebRequest.SetMethod(webRequest=byUrl, method=string_2)
string_3 = StringInput("Authorization")
code_block_13 = CodeBlock(token=token_here_without_bearer)
# ---------- code_block_13.designscript (2 lines) ----------
"Bearer "+
token;
# ----------------------------------------
addHeader = DynaWeb.WebRequest.AddHeader(webRequest=setMethod, name=string_3, value=code_block_13)
execute = DynaWeb.WebRequest.Execute(request=addHeader)
content = DynaWeb.WebResponse.Content(webResponse=execute)
string_4 = JsonData.Utilities.Parse.String(jsonString=content)
toDictionary = JsonData.Elements.JsonObject.ToDictionary(jsonObject=string_4)
components = DesignScript.Builtin.Dictionary.Components(dictionary=toDictionary)
firstItem_2 = List.FirstItem(list=components.values)
code_block_14 = CodeBlock()
# ---------- code_block_14.designscript (4 lines) ----------
["View Name",
"View Title on Sheet",
"Version Number",
"ViewID"];
# ----------------------------------------
valueAtKey = DesignScript.Builtin.Dictionary.ValueAtKey(dictionary=firstItem_2, key=code_block_14, lacing=CrossProduct)

# group: Join Lists
addItemToFront = List.AddItemToFront(item=list_create_3, list=valueAtKey)
flatten = List.Flatten(list=addItemToFront)

# group: Check if versions match
code_block_15 = CodeBlock { 4; 8; }
getItemAtIndex_2 = List.GetItemAtIndex(list=flatten, index=code_block_15.out0)
getItemAtIndex_3 = List.GetItemAtIndex(list=flatten, index=code_block_15.out1)
eq_2 = getItemAtIndex_2 == getItemAtIndex_3
code_block_16 = CodeBlock { "Yes"; "No"; }
if_ = RefactoredIf(test=eq_2, true=code_block_16.out0, false=code_block_16.out1)

# group: Update match field with result of check
code_block_17 = CodeBlock { 0; }
replaceItemAtIndex = List.ReplaceItemAtIndex(list=flatten, index=code_block_17, item=if_)

# group: Create report
ʳʰʸᵗʰᵐ_system_2 = Rhythm.Helpers.System.CurrentUserTempFolder()
string_5 = StringInput("DetailsCheck.xlsx")
code_block_18 = CodeBlock(path=ʳʰʸᵗʰᵐ_system_2, File=string_5) { path+ File; }
code_block_19 = CodeBlock { "Results"; }
code_block_20 = CodeBlock { 1; 0; }
list_create_4 = List.Create(item0=replaceItemAtIndex)
code_block_21 = CodeBlock { false; }

# group: Export resiults
exportToExcel_2 = Data.ExportToExcel(filePath=code_block_18, sheetName=code_block_19, startRow=code_block_20.out0, startColumn=code_block_20.out1, data=list_create_4, overWrite=code_block_21)
