# Dynamo graph Element Related (2023).dyn (Dynamo 2.6.2.15705)
# packages: archi-lab.net 2023.213.1722, JsonData 2.0.2

# group: Loaded Families: Get List of Family Types and parameters
# note: Custom node solution found in Dynamo Forums;
# Credit: Marc Tavenier @marctavenier
# note: Get list of Elements of the Family class
python_script = Python()
# ---------- python_script.python (20 lines) ----------
#Made by Marc Tavenier @marctavenier
import clr
clr.AddReference('RevitAPI')
from Autodesk.Revit.DB import *

clr.AddReference('RevitServices')
import RevitServices
from RevitServices.Persistence import DocumentManager

#The inputs to this node will be stored as a list in the IN variable.
dataEnteringNode = IN

elementlist = []
doc = DocumentManager.Instance.CurrentDBDocument

collector = FilteredElementCollector(doc).OfClass(Family)
elementlist = collector.ToElements()

#Assign your output to the OUT variable
OUT = elementlist
# ----------------------------------------
types = Family.Types(family=python_script)
# note: Get family type for each element,
# then get their Parameters
flatten = List.Flatten(list=types)
family = FamilyType.Family(familyType=flatten)
parameters = Element.Parameters(element=flatten)
id = Parameter.Id(parameter=parameters)
string_from_object = FromObject(obj=id)
# note: Combine strings so they are formatted
# "ParameterID|ParameterName : Value"
code_block = CodeBlock(x=string_from_object, y=parameters) { x+"|"+y; }
code_block_2 = CodeBlock { " : "; }
split = String.Split(str=code_block, separator0=code_block_2)

# note: Watch: List of Types
watch = Watch(flatten)

# group: Get Parameter Values
code_block_3 = CodeBlock { 0; }
removeItemAtIndex = List.RemoveItemAtIndex(list=split@@L2, indices=code_block_3)
code_block_4 = CodeBlock { "-BLANK-"; }
# note: Replace empty lists with special value and concatenate parameters with multiple values to preserve list length and structure
replaceEmptyList = archilab.Lists.Lists.ReplaceEmptyList(list=removeItemAtIndex, replacement=code_block_4)
code_block_5 = CodeBlock { "|"; }
concat = String.Concat(string0=replaceEmptyList@@L2, string1=code_block_5)
code_block_6 = CodeBlock { 1; }
# note: Flatten to maintain levels:
# L2 = Elements
# L1 = Parameters
flatten_2 = List.Flatten(list=concat, amt=code_block_6)

# group: Insert Values for Family and Family Type EID and GUID
uniqueId = Element.UniqueId(element=family)
# note: Parent Family GUID
string_from_object_2 = FromObject(obj=uniqueId)
id_2 = Element.Id(element=family)
# note: Parent Family EID
string_from_object_3 = FromObject(obj=id_2)
id_3 = Element.Id(element=watch)
# note: Family Type GUID
string_from_object_4 = FromObject(obj=id_3)
uniqueId_2 = Element.UniqueId(element=watch)
# note: Family Type EID
string_from_object_5 = FromObject(obj=uniqueId_2)
addItemToFront = List.AddItemToFront(item=string_from_object_5@L1, list=flatten_2@L2)
addItemToFront_2 = List.AddItemToFront(item=string_from_object_4@L1, list=addItemToFront@L2)
addItemToFront_3 = List.AddItemToFront(item=string_from_object_3@L1, list=addItemToFront_2@L2)
addItemToFront_4 = List.AddItemToFront(item=string_from_object_2@L1, list=addItemToFront_3@L2)

watch_2 = Watch(addItemToFront_4)

# group: Placed Families: Get all elements of Type FamilyInstance
element_types = ElementTypes("FamilyInstance")
# note: Get all elements of FamilyInstance Type
all_elements_of_type = ElementsOfType(element_type=element_types)
# note: Get all element parameters
parameters_2 = Element.Parameters(element=all_elements_of_type)

# group: Add parameter ID value to parameter name, get unique values
id_4 = Parameter.Id(parameter=parameters_2)
string_from_object_6 = FromObject(obj=id_4)
string_from_object_7 = FromObject(obj=parameters_2)
# note: Combine strings so they are formatted
# "ParameterID|ParameterName : Value"
code_block_7 = CodeBlock(x=string_from_object_6, y=string_from_object_7) { x+"|"+y; }
# note: Get unique list
uniqueItems = List.UniqueItems(list=code_block_7@L2)

# group: Split parameter name from value
string = StringInput(" : ")
# note: Headers at Index = 0
# Values at Index = 1
split_2 = String.Split(str=uniqueItems, separator0=string)
code_block_8 = CodeBlock { 0; }
getItemAtIndex = List.GetItemAtIndex(list=split_2@@L2, index=code_block_8)
removeItemAtIndex_2 = List.RemoveItemAtIndex(list=split_2@@L2, indices=code_block_8)
code_block_9 = CodeBlock { "-BLANK-"; }
# note: Replace empty lists with special value to preserve list length for headers and values
replaceEmptyList_2 = archilab.Lists.Lists.ReplaceEmptyList(list=removeItemAtIndex_2, replacement=code_block_9)
concat_2 = String.Concat(string0=replaceEmptyList_2@@L2)

# group: Add EID and GUID paramater slots
string_2 = StringInput("GUID|GUID")
string_3 = StringInput("EID|EID")
# note: Levels:
# L2 = Elements
# L1 = Parameters
addItemToFront_5 = List.AddItemToFront(item=string_3, list=getItemAtIndex@L2)
addItemToFront_6 = List.AddItemToFront(item=string_2, list=addItemToFront_5@L2)

# group: Get Element ID and GUID values, add to list
uniqueId_3 = Element.UniqueId(element=all_elements_of_type)
string_from_object_8 = FromObject(obj=uniqueId_3)
id_5 = Element.Id(element=all_elements_of_type)
string_from_object_9 = FromObject(obj=id_5)
# note: Levels:
# L2 = Elements
# L1 = Parameters
addItemToFront_7 = List.AddItemToFront(item=string_from_object_9@L1, list=concat_2@@L2)
addItemToFront_8 = List.AddItemToFront(item=string_from_object_8@L1, list=addItemToFront_7@@L2)

# group: Specify Directory Path for JSON Outputs
# note: User-specified output folder is
#  same for all JSON otuputs
directory_path = Directory("C:\_scratch\Project AA12345\20230608")  # graph input
# note: To add prefix, add new line to 'String.Concat' node and connect it to the 'string' output of the DateTime.Format node
string_4 = StringInput("\")
# note: Add '\' to end of directory
concat_3 = String.Concat(string0=directory_path, string1=string_4)
now = DateTime.Now()
# note: Optional: prefix file name with datestamp to distinguish multiple outputs from the same model
code_block_10 = CodeBlock { "yyMMdd-HHMMss"; }
format = DateTime.Format(dateTime=now, format=code_block_10)

# group: Name output JSON file: Placed Families
string_5 = StringInput("FamiliesInPlace.json")
concat_4 = String.Concat(string0=concat_3, string1=string_5)

# group: Define dictionary, split into keys and values, export to JSON
byKeysValues = DesignScript.Builtin.Dictionary.ByKeysValues(keys=addItemToFront_6@L2, values=addItemToFront_8@L2)
keys = DesignScript.Builtin.Dictionary.Keys(dictionary=byKeysValues)
values = DesignScript.Builtin.Dictionary.Values(dictionary=byKeysValues)
byKeysAndValues = JsonObject.ByKeysAndValues(keys=keys@L2, values=values@L2, Nesting=true, Option="None")
toJsonFile = JsonData.Utilities.Write.ToJsonFile(jsonObjects=byKeysAndValues, filepath=concat_4)

# group: Add Headers for Family and Family Type EID and GUID
code_block_11 = CodeBlock()
# ---------- code_block_11.designscript (4 lines) ----------
"Family GUID|Family GUID";
"Family EID|Family EID";
"Family Type GUID|Family Type GUID";
"Family Type EID|Family Type EID";
# ----------------------------------------
code_block_12 = CodeBlock { 0; }
getItemAtIndex_2 = List.GetItemAtIndex(list=split@@L2, index=code_block_12)
addItemToFront_9 = List.AddItemToFront(item=code_block_11.out3, list=getItemAtIndex_2@L2)
addItemToFront_10 = List.AddItemToFront(item=code_block_11.out2, list=addItemToFront_9@L2)
addItemToFront_11 = List.AddItemToFront(item=code_block_11.out1, list=addItemToFront_10@L2)
addItemToFront_12 = List.AddItemToFront(item=code_block_11.out0, list=addItemToFront_11@L2)
byKeysValues_2 = DesignScript.Builtin.Dictionary.ByKeysValues(keys=addItemToFront_12@L2, values=addItemToFront_4@L2)

# group: Name output JSON file: Loaded Families
string_6 = StringInput("FamiliesLoaded.json")
concat_5 = String.Concat(string0=concat_3, string1=string_6)

# group: Define dictionary, split into keys and values, export to JSON
keys_2 = DesignScript.Builtin.Dictionary.Keys(dictionary=byKeysValues_2)
values_2 = DesignScript.Builtin.Dictionary.Values(dictionary=byKeysValues_2)
byKeysAndValues_2 = JsonObject.ByKeysAndValues(keys=keys_2@L2, values=values_2@L2, Nesting=true, Option="None")
toJsonFile_2 = JsonData.Utilities.Write.ToJsonFile(jsonObjects=byKeysAndValues_2, filepath=concat_5)

# group: Model and Detail Groups: Get all Elements of Type Group
element_types_2 = ElementTypes("Group")
all_elements_of_type_2 = ElementsOfType(element_type=element_types_2)

# group: Get specific parameter values and element Type / Name
# note: Define list of headers
code_block_13 = CodeBlock()
# ---------- code_block_13.designscript (5 lines) ----------
["Category",
"Edited by",
"Origin Level Offset",
"Type",
"Family Name"];
# ----------------------------------------
code_block_14 = CodeBlock { "Family"; }
getParameterValueByName = Element.GetParameterValueByName(element=all_elements_of_type_2@@L1, parameterName=code_block_14)
code_block_15 = CodeBlock { "Family Name"; }
# note: Get Value for Family Parameter value,
# then retrieve Family Name from Parameter
getParameterValueByName_2 = Element.GetParameterValueByName(element=getParameterValueByName@@L1, parameterName=code_block_15)
# note: Element Name = Element Type in this case
name = Element.Name(element=all_elements_of_type_2)
code_block_16 = CodeBlock()
# ---------- code_block_16.designscript (3 lines) ----------
["Category",
"Edited by",
"Origin Level Offset"];
# ----------------------------------------
# note: Get values of specific element parameters
getParameterValueByName_3 = Element.GetParameterValueByName(element=all_elements_of_type_2@@L1, parameterName=code_block_16)
# note: Level Hierarchy:
# L2 = Group Name
# L1 = Parameters
# note: Append list of Types to list
# of other parameter values
addItemToEnd = List.AddItemToEnd(item=name@L1, list=getParameterValueByName_3@L2)

# note: Add Family Name to list
addItemToEnd_2 = List.AddItemToEnd(item=getParameterValueByName_2@L1, list=addItemToEnd@L2)

# group: Name output JSON file: Model and Detail Groups
string_7 = StringInput("ModelAndDetailGroups.json")
concat_6 = String.Concat(string0=concat_3, string1=string_7)

# group: Define dictionary, split into keys and values, export to JSON
byKeysValues_3 = DesignScript.Builtin.Dictionary.ByKeysValues(keys=code_block_13, values=addItemToEnd_2@L2)
keys_3 = DesignScript.Builtin.Dictionary.Keys(dictionary=byKeysValues_3)
values_3 = DesignScript.Builtin.Dictionary.Values(dictionary=byKeysValues_3)
byKeysAndValues_3 = JsonObject.ByKeysAndValues(keys=keys_3@L2, values=values_3@L2, Nesting=false, Option="None")
toJsonFile_3 = JsonData.Utilities.Write.ToJsonFile(jsonObjects=byKeysAndValues_3, filepath=concat_6)

# group: Get Categories for all 3 Element Classes, combine into single list
# note: archi-lab node
getAll = archilab.Revit.Elements.Categories.GetAll()
all_elements_of_category = ElementsOfCategory(Category=getAll.Model)
flatten_3 = List.Flatten(list=all_elements_of_category)
# note: Split out elements before combining so we can sneak in a header that indicates the class of the element (Model, Annotation, Analytical)
clean = List.Clean(list=flatten_3)
all_elements_of_category_2 = ElementsOfCategory(Category=getAll.Annotation)
flatten_4 = List.Flatten(list=all_elements_of_category_2)
clean_2 = List.Clean(list=flatten_4)
all_elements_of_category_3 = ElementsOfCategory(Category=getAll.Analytical)
flatten_5 = List.Flatten(list=all_elements_of_category_3)
clean_3 = List.Clean(list=flatten_5)
code_block_17 = CodeBlock { "Class : Model|Category : "; }
string_from_object_10 = FromObject(obj=clean)
code_block_18 = CodeBlock { "|Category Name : "; }
name_2 = Element.Name(element=clean)
# note: This creates a lookup table that maps
# Element Categories to their Class
# (Model, Annotation, or Analytical)
code_block_19 = CodeBlock(a=code_block_17, b=string_from_object_10, c=code_block_18, d=name_2) { a+b+c+d; }
code_block_20 = CodeBlock { "Class : Annotation|Category : "; }
string_from_object_11 = FromObject(obj=clean_2)
code_block_21 = CodeBlock { "|Category Name : "; }
name_3 = Element.Name(element=clean_2)
code_block_22 = CodeBlock(a=code_block_20, b=string_from_object_11, c=code_block_21, d=name_3) { a+b+c+d; }
code_block_23 = CodeBlock { "Class : Analytical|Category : "; }
string_from_object_12 = FromObject(obj=clean_3)
code_block_24 = CodeBlock { "|Category Name : "; }
name_4 = Element.Name(element=clean_3)
code_block_25 = CodeBlock(a=code_block_23, b=string_from_object_12, c=code_block_24, d=name_4) { a+b+c+d; }
# note: 0 = Model elements
# 1 = Annotation elements
# 2 = Analytical elements
list_create = List.Create(item0=code_block_19, item1=code_block_22, item2=code_block_25)

# group: Get all Model Elements from All Categories, plus value of Workset parameter
# note: Start with getting only elements
# of the Model category
all_elements_of_category_4 = ElementsOfCategory(Category=getAll.Model)
flatten_6 = List.Flatten(list=all_elements_of_category_4)
code_block_26 = CodeBlock { "Workset"; }
# note: Extract values of workset
# parameter from each element
getParameterValueByName_4 = Element.GetParameterValueByName(element=flatten_6, parameterName=code_block_26)

# group: Create List: For Elements of Model Category, get parameter values for UserWorksets
# note: Node contents taken from GeniusLoci package. Rather than having you add another package to workspace, we've taken the heart of the node out (just the Python script).
# note: Get workset kind and name for all elements
python_script_2 = Python(IN[0]=getParameterValueByName_4)
# ---------- python_script_2.python (30 lines) ----------
#Alban de Chasteigner 2021
#twitter : @geniusloci_bim
#geniusloci.bim@gmail.com
#https://github.com/albandechasteigner/GeniusLociForDynamo

import clr
# Import DocumentManager and TransactionManager
clr.AddReference("RevitServices")
import RevitServices
from RevitServices.Persistence import DocumentManager
doc = DocumentManager.Instance.CurrentDBDocument
# Import RevitAPI
clr.AddReference("RevitAPI")
import Autodesk
from Autodesk.Revit.DB import WorksetId

ids = IN[0] if isinstance(IN[0],list) else [IN[0]]
wks, names = [],[]

for worksetId in ids :
	try:
		workset=doc.GetWorksetTable().GetWorkset(WorksetId(worksetId))
		wks.append(workset)
		names.append(workset.Name)
	except:
		wks.append(None)
		names.append(None)
		
if isinstance(IN[0], list): OUT = wks, names
else: OUT = wks[0], names[0]
# ----------------------------------------
deconstruct = List.Deconstruct(list=python_script_2)
# note: Python scripts gets kind of workset
python_script_3 = Python(IN[0]=deconstruct.first)
# ---------- python_script_3.python (15 lines) ----------
import clr
clr.AddReference('RevitAPI')
from Autodesk.Revit.DB import *

def WorksetKind(workset):
	if workset.GetType().ToString() == "Autodesk.Revit.DB.Workset":
		return str(workset.Kind)
	elif workset.GetType().ToString() == "archilab.Revit.Elements.Workset":
		return "Cannot retrieve the workset kind from a workset object generated by archi-lab nodes."
	else: return None

worksets = UnwrapElement(IN[0])

if isinstance(IN[0], list): OUT = [WorksetKind(x) for x in worksets]
else: OUT = WorksetKind(worksets)
# ----------------------------------------
code_block_27 = CodeBlock { "UserWorkset"; }
# note: Keep only Worksets that
# are "UserWorksets"
contains = String.Contains(str=python_script_3, searchFor=code_block_27)
filterByBoolMask = List.FilterByBoolMask(list=flatten_6, mask=contains)
name_5 = Element.Name(element=filterByBoolMask.in)
# note: Flatten list of workset names
flatten_7 = List.Flatten(list=deconstruct.rest)
filterByBoolMask_2 = List.FilterByBoolMask(list=flatten_7, mask=contains)
code_block_28 = CodeBlock()
# ---------- code_block_28.designscript (2 lines) ----------
["Category",
"Level"];
# ----------------------------------------
# note: Start with Element Name, Category, Level and Workset because desired values are easily accessible
getParameterValueByName_5 = Element.GetParameterValueByName(element=filterByBoolMask.in@L1, parameterName=code_block_28)

# group: Add to list: Parameter values associated with Type, Elevation, and Family
# note: Start with only UserWorkset Elements, the get filter for specific parameter values
parameters_3 = Element.Parameters(element=filterByBoolMask.in)
string_from_object_13 = FromObject(obj=parameters_3)
code_block_29 = CodeBlock { "Type : "; }
startsWith = String.StartsWith(str=string_from_object_13, searchFor=code_block_29)
filterByBoolMask_3 = List.FilterByBoolMask(list=string_from_object_13, mask=startsWith)
code_block_30 = CodeBlock { "Type : -BLANK-"; }
# note: Elevation-related parameters are inconsistent across elements, so replace empty lists with a blank to preserve list length
replaceEmptyList_3 = archilab.Lists.Lists.ReplaceEmptyList(list=filterByBoolMask_3.in, replacement=code_block_30)
code_block_31 = CodeBlock { "Family : "; }
startsWith_2 = String.StartsWith(str=string_from_object_13, searchFor=code_block_31)
filterByBoolMask_4 = List.FilterByBoolMask(list=string_from_object_13, mask=startsWith_2)
code_block_32 = CodeBlock { "Family : -BLANK-"; }
replaceEmptyList_4 = archilab.Lists.Lists.ReplaceEmptyList(list=filterByBoolMask_4.in, replacement=code_block_32)
addItemToEnd_3 = List.AddItemToEnd(item=replaceEmptyList_3@L2, list=replaceEmptyList_4@L2)
# note: Append lists together:
# * preserve list length using levels,
# * preserve hierarchy by flattening
# note: Header groupings (variable length):
# 0: Family-related (0-3 items)
# 1: Elevation-related (0-6 items)
# 2: Type-related (0-3 items)
flatten_8 = List.Flatten(list=addItemToEnd_3@L3)
# note: L1 = Parameter
# L2 = Element
code_block_33 = CodeBlock { " : "; }

string_from_object_14 = FromObject(obj=getParameterValueByName_5)

# group (continued): Create List: For Elements of Model Category, get parameter values for UserWorksets
# note: Headers:
# 0: Category
# 1: Level
# 2: Workset
addItemToEnd_4 = List.AddItemToEnd(item=filterByBoolMask_2.in@L1, list=string_from_object_14@L2)
# note: L1 = Parameter
# L2 = Element
# note: Headers:
# 0: Element Name
# 1: Category
# 2: Level
# 3: Workset
addItemToFront_13 = List.AddItemToFront(item=name_5@L1, list=addItemToEnd_4@L2)

# note: Headers:
# 0: Element Name
# 1: Category
# 2: Level
# 3: Workset
watch_3 = Watch(addItemToFront_13)

# group: Format list: split headers from values; append values list
code_block_34 = CodeBlock()
# ---------- code_block_34.designscript (4 lines) ----------
["Element Name",
"Category",
"Level",
"Workset Name"];
# ----------------------------------------
split_3 = String.Split(str=flatten_8, separator0=code_block_33)
code_block_35 = CodeBlock { 0; }
getItemAtIndex_3 = List.GetItemAtIndex(list=split_3@@L2, index=code_block_35)
# note: Other paramter values did not come with headers, so need to add some here in front
# note: Replace Empty lists to preserve consistent
# length between headers and values
addItemToFront_14 = List.AddItemToFront(item=code_block_34, list=getItemAtIndex_3@@L2)
flatten_9 = List.Flatten(list=addItemToFront_14@L3)
code_block_36 = CodeBlock { 0; }
removeItemAtIndex_3 = List.RemoveItemAtIndex(list=split_3@@L2, indices=code_block_36)
code_block_37 = CodeBlock { "-BLANK-"; }
replaceEmptyList_5 = archilab.Lists.Lists.ReplaceEmptyList(list=removeItemAtIndex_3, replacement=code_block_37)
flatten_10 = List.Flatten(list=replaceEmptyList_5@L3)
addItemToEnd_5 = List.AddItemToEnd(item=flatten_10@L2, list=watch_3@L2)
# note: Append lists together:
# * preserve list length using levels,
# * preserve hierarchy by flattening
# note: Headers:
# 0: Element Name (1 item)
# 1: Category (1 item)
# 2: Level (1 item)
# 3: Family-related (0-3 items)
# 4: Elevation-related (0-6 items)
# 5: Type-related (0-3 items)
# 6: Workset
flatten_11 = List.Flatten(list=addItemToEnd_5@L3)

# group: Name output JSON file: Workset Elements
string_8 = StringInput("WorksetElements.json")
concat_7 = String.Concat(string0=concat_3, string1=string_8)

# group: Define dictionary, split into keys and values, export to JSON
byKeysValues_4 = DesignScript.Builtin.Dictionary.ByKeysValues(keys=flatten_9@L2, values=flatten_11@L2)
keys_4 = DesignScript.Builtin.Dictionary.Keys(dictionary=byKeysValues_4)
values_4 = DesignScript.Builtin.Dictionary.Values(dictionary=byKeysValues_4)
byKeysAndValues_4 = JsonObject.ByKeysAndValues(keys=keys_4@L2, values=values_4@L2, Nesting=true, Option="None")
toJsonFile_4 = JsonData.Utilities.Write.ToJsonFile(jsonObjects=byKeysAndValues_4, filepath=concat_7)

# group: Get List of All Worksets
# note: archi-lab node
getAll_2 = archilab.Revit.Elements.Workset.GetAll()
string_from_object_15 = FromObject(obj=getAll_2)

# group: Format List of Worksets
code_block_38 = CodeBlock { "Workset(Name:"; "Workset Name:"; }
# note: Change Parameter name from "Workset" to "Workset Name" by eliminating Parentheses
replace = String.Replace(str=string_from_object_15, searchFor=code_block_38.out0, replaceWith=code_block_38.out1)
code_block_39 = CodeBlock { ")"; ""; }
# note: Eliminate ')' at the end
replace_2 = String.Replace(str=replace, searchFor=code_block_39.out0, replaceWith=code_block_39.out1)
code_block_40 = CodeBlock { ": "; }
# note: Split headers from values
split_4 = String.Split(str=replace_2@@L1, separator0=code_block_40)
code_block_41 = CodeBlock { 0; }
# note: Flatten list to preserve hierarchy:
# L1= Workset (No other levels)
getItemAtIndex_4 = List.GetItemAtIndex(list=split_4@@L2, index=code_block_41)
restOfItems = List.RestOfItems(list=split_4@L2)
flatten_12 = List.Flatten(list=restOfItems)

# group: Name output JSON file: Worksets
string_9 = StringInput("WorksetList.json")
concat_8 = String.Concat(string0=concat_3, string1=string_9)

# group: Define dictionary, split into keys and values, export to JSON
byKeysValues_5 = DesignScript.Builtin.Dictionary.ByKeysValues(keys=getItemAtIndex_4@L1, values=flatten_12@L1)
keys_5 = DesignScript.Builtin.Dictionary.Keys(dictionary=byKeysValues_5)
values_5 = DesignScript.Builtin.Dictionary.Values(dictionary=byKeysValues_5)
byKeysAndValues_5 = JsonObject.ByKeysAndValues(keys=keys_5@L1, values=values_5@L1, Nesting=true, Option="None")
toJsonFile_5 = JsonData.Utilities.Write.ToJsonFile(jsonObjects=byKeysAndValues_5, filepath=concat_8)

# group: Create element list and get parameters
# note: Combine elements from all 3 categories, flatten list
# note: 0 = Model elements
# 1 = Annotation elements
# 2 = Analytical elements
list_create_2 = List.Create(item0=clean, item1=clean_2, item2=clean_3)
flatten_13 = List.Flatten(list=list_create_2)
# note: Get all parameters
# note: We could search for multiple strings, but this would not return the correct names. To retain precise control over formatting, I've split worfklow for getting each.
parameters_4 = Element.Parameters(element=flatten_13)

# group: Get Element Name and Category
# note: Using the OOB nodes gets us the values, but need to insert string for the header in front of each item
code_block_42 = CodeBlock { "Element Name : "; }
name_6 = Element.Name(element=flatten_13)
code_block_43 = CodeBlock(a=code_block_42, b=name_6) { a+b; }
code_block_44 = CodeBlock { "Category : "; }
getCategory = Element.GetCategory(element=flatten_13)
code_block_45 = CodeBlock(a=code_block_44, b=getCategory) { a+b; }
# note: L1 = Parameter & Value
# L2 = Element
addItemToFront_15 = List.AddItemToFront(item=code_block_43@L1, list=code_block_45@L1)

# group: Get Element Family name, then format and append to element list
code_block_46 = CodeBlock { "|"; }
string_from_object_16 = FromObject(obj=parameters_4)
code_block_47 = CodeBlock { "Family : "; }
# note: Find the "Family" parameter, if it exists
startsWith_3 = String.StartsWith(str=string_from_object_16, searchFor=code_block_47)
filterByBoolMask_5 = List.FilterByBoolMask(list=string_from_object_16, mask=startsWith_3)
code_block_48 = CodeBlock { "Family : -BLANK-"; }
# note: Replace empty lists with string
# to preserve data structure
replaceEmptyList_6 = archilab.Lists.Lists.ReplaceEmptyList(list=filterByBoolMask_5.in, replacement=code_block_48)
# note: Concatenate elements with multiple values to preserve list size using " | " as delimiter
join = String.Join(separator=code_block_46, string0=replaceEmptyList_6)
code_block_49 = CodeBlock { "|Family : "; " | "; }
replace_3 = String.Replace(str=join@L1, searchFor=code_block_49.out0, replaceWith=code_block_49.out1)
# note: Add to list, one item per element
addItemToEnd_6 = List.AddItemToEnd(item=replace_3@L1, list=addItemToFront_15@L2)

# group: Get Element Type name(s), then format and append to element list
code_block_50 = CodeBlock { "|"; }
string_from_object_17 = FromObject(obj=parameters_4)
code_block_51 = CodeBlock { "Type :"; }
# note: Find the "Type" parameter, if it exists
startsWith_4 = String.StartsWith(str=string_from_object_17, searchFor=code_block_51)
filterByBoolMask_6 = List.FilterByBoolMask(list=string_from_object_17, mask=startsWith_4)
code_block_52 = CodeBlock { "Type|Type Id|Type Name : -BLANK-"; }
# note: Replace empty lists with string
# to preserve data structure
replaceEmptyList_7 = archilab.Lists.Lists.ReplaceEmptyList(list=filterByBoolMask_6.in, replacement=code_block_52)
# note: Concatenate elements with multiple values to preserve list size using " | " as delimiter
join_2 = String.Join(separator=code_block_50, string0=replaceEmptyList_7)
code_block_53 = CodeBlock { "|Type|Type Id|Type Name : "; " | "; }
replace_4 = String.Replace(str=join_2@L1, searchFor=code_block_53.out0, replaceWith=code_block_53.out1)
# note: Add to list, one item per element
addItemToEnd_7 = List.AddItemToEnd(item=replace_4@L1, list=addItemToEnd_6@L2)

# group: Get Element Workset name, then format and append to element list
code_block_54 = CodeBlock { "|"; }
string_from_object_18 = FromObject(obj=parameters_4)
code_block_55 = CodeBlock { "Workset :"; }
# note: Find the "Workset" parameter, if it exists
startsWith_5 = String.StartsWith(str=string_from_object_18, searchFor=code_block_55)
filterByBoolMask_7 = List.FilterByBoolMask(list=string_from_object_18, mask=startsWith_5)
code_block_56 = CodeBlock { "Workset : -BLANK-"; }
# note: Replace empty lists with string
# to preserve data structure
replaceEmptyList_8 = archilab.Lists.Lists.ReplaceEmptyList(list=filterByBoolMask_7.in, replacement=code_block_56)
# note: Concatenate elements with multiple values to preserve list size using " | " as delimiter
join_3 = String.Join(separator=code_block_54, string0=replaceEmptyList_8)
code_block_57 = CodeBlock { "|Workset : "; " | "; }
replace_5 = String.Replace(str=join_3@L1, searchFor=code_block_57.out0, replaceWith=code_block_57.out1)
# note: Add to list, one item per element
addItemToEnd_8 = List.AddItemToEnd(item=replace_5@L1, list=addItemToEnd_7@L2)

code_block_58 = CodeBlock { 1; }

# group: Combine lists, flatten, and separate headers from values
flatten_14 = List.Flatten(list=list_create)
code_block_59 = CodeBlock { "|"; }
split_5 = String.Split(str=flatten_14, separator0=code_block_59)
code_block_60 = CodeBlock { " : "; }
split_6 = String.Split(str=split_5, separator0=code_block_60)
code_block_61 = CodeBlock { 0; }
getItemAtIndex_5 = List.GetItemAtIndex(list=split_6@@L2, index=code_block_61)
code_block_62 = CodeBlock { "|"; }
code_block_63 = CodeBlock { 0; }
removeItemAtIndex_4 = List.RemoveItemAtIndex(list=split_6@@L2, indices=code_block_63)
code_block_64 = CodeBlock { "-BLANK-"; }
# note: Replace empty lists and join multi-value parameters to preserve list length; flatten to preserve hierarchy
replaceEmptyList_9 = archilab.Lists.Lists.ReplaceEmptyList(list=removeItemAtIndex_4, replacement=code_block_64)
join_4 = String.Join(separator=code_block_62, string0=replaceEmptyList_9)
flatten_15 = List.Flatten(list=join_4@L2, amt=code_block_58)

# group: Name Output JSON file: Element Category Classes
string_10 = StringInput("ElementCategoryClasses.json")
concat_9 = String.Concat(string0=concat_3, string1=string_10)

# group: Define dictionary, split keys and values, export as JSON file
byKeysValues_6 = DesignScript.Builtin.Dictionary.ByKeysValues(keys=getItemAtIndex_5@L2, values=flatten_15@L2)
keys_6 = DesignScript.Builtin.Dictionary.Keys(dictionary=byKeysValues_6)
values_6 = DesignScript.Builtin.Dictionary.Values(dictionary=byKeysValues_6)
# note: File Name for Element Category Class
byKeysAndValues_6 = JsonObject.ByKeysAndValues(keys=keys_6@L2, values=values_6@L2, Nesting=true, Option="None")
toJsonFile_6 = JsonData.Utilities.Write.ToJsonFile(jsonObjects=byKeysAndValues_6, filepath=concat_9)

# group: Wait for first JSON file output to complete
# note: Let the Element Category Classes file finish first before generating Element llist (seems to reduce issues running)
list_create_3 = List.Create(item0=addItemToEnd_8, item1=toJsonFile_6)
firstItem = List.FirstItem(list=list_create_3)

# group: Split headers from values as separate lists, format for dictionary
code_block_65 = CodeBlock { " : "; }
split_7 = String.Split(str=firstItem, separator0=code_block_65)
code_block_66 = CodeBlock { 0; }
# note: New list for parameter headers
getItemAtIndex_6 = List.GetItemAtIndex(list=split_7@@L2, index=code_block_66)
code_block_67 = CodeBlock { "|"; }
code_block_68 = CodeBlock { 0; }
# note: Remove headers, leave parameter Values
removeItemAtIndex_5 = List.RemoveItemAtIndex(list=split_7@@L2, indices=code_block_68)
# note: Replace Empty Lists to preserve list size
code_block_69 = CodeBlock { "-BLANK-"; }
replaceEmptyList_10 = archilab.Lists.Lists.ReplaceEmptyList(list=removeItemAtIndex_5, replacement=code_block_69)
# note: Concatenate multi-value parameters
# to preserve list list
join_5 = String.Join(separator=code_block_67, string0=replaceEmptyList_10)
code_block_70 = CodeBlock { 1; }
# note: Flatten to maintain
# consistent data hierarchy
flatten_16 = List.Flatten(list=join_5, amt=code_block_70)

# group: Name Output JSON file: Elements
string_11 = StringInput("Elements.json")
concat_10 = String.Concat(string0=concat_3, string1=string_11)

# group: Define dictionary, split keys and values, export as JSON file
byKeysValues_7 = DesignScript.Builtin.Dictionary.ByKeysValues(keys=getItemAtIndex_6@L2, values=flatten_16@L2)
keys_7 = DesignScript.Builtin.Dictionary.Keys(dictionary=byKeysValues_7)
values_7 = DesignScript.Builtin.Dictionary.Values(dictionary=byKeysValues_7)
# note: File Name for Elements
byKeysAndValues_7 = JsonObject.ByKeysAndValues(keys=keys_7@L2, values=values_7@L2, Nesting=true, Option="None")
toJsonFile_7 = JsonData.Utilities.Write.ToJsonFile(jsonObjects=byKeysAndValues_7, filepath=concat_10)

# note: Size of output dictionary
# needs to match list size
count = List.Count(list=flatten_13)
watch_4 = Watch(count)
