# Dynamo graph External References (2023).dyn (Dynamo 2.6.2.15705)
# packages: JsonData 2.0.2, archi-lab.net 2023.213.1722

# group: Links: Get all elements of 'RVT Links' Category and all element parameters
categories = Categories("OST_RvtLinks")
all_elements_of_category = ElementsOfCategory(Category=categories)
parameters = Element.Parameters(element=all_elements_of_category)

# group: Add ID to parameter name
id = Parameter.Id(parameter=parameters)
string_from_object = FromObject(obj=id)
string_from_object_2 = FromObject(obj=parameters)
# note: Combine parameter name
# and value into single string
code_block = CodeBlock(x=string_from_object, y=string_from_object_2) { x+"|"+y; }

# group: Get unique values, split parameter name from values
uniqueItems = List.UniqueItems(list=code_block@L2)
string = StringInput(" : ")
# note: Index 0 = [Parameter Name]|[ID]
# Index 1 = Parameter Value
split = String.Split(str=uniqueItems, separator0=string)
code_block_2 = CodeBlock { 0; }
# note: Get Index 0 to retrieve
# Parameter Name + ID
getItemAtIndex = List.GetItemAtIndex(list=split@@L2, index=code_block_2)
# note: Remove Index 0 to keep Values and convert blank values into empty lists
removeItemAtIndex = List.RemoveItemAtIndex(list=split@@L2, indices=code_block_2)

# group: Add EID and GUID headers
string_2 = StringInput("GUID|GUID")
string_3 = StringInput("EID|EID")
addItemToFront = List.AddItemToFront(item=string_3, list=getItemAtIndex@L2)
addItemToFront_2 = List.AddItemToFront(item=string_2, list=addItemToFront@L2)

# note: Preview elements of RVT Links Category
watch = Watch(all_elements_of_category)

# group: Replace empty lists & concatenate multi-value parameters
code_block_3 = CodeBlock { "-BLANK-"; }
# note: Replace Empty Lists w/ "-BLANK-" to ensure
# headers and Value lists remain same length
replaceEmptyList = archilab.Lists.Lists.ReplaceEmptyList(list=removeItemAtIndex, replacement=code_block_3)
# note: Concatenate multi-value parameters
# to ensure Lists remain same length
concat = String.Concat(string0=replaceEmptyList@@L2)
code_block_4 = CodeBlock { 1; }
# note: Flatten list so that:
# @L1 = Parameter Value
# @L2 = Element
flatten = List.Flatten(list=concat, amt=code_block_4)

# group: Add Element ID and GUID to list of values
uniqueId = Element.UniqueId(element=watch)
string_from_object_3 = FromObject(obj=uniqueId)
# note: Add ID first, then GUID to
# match ordering of header labels
id_2 = Element.Id(element=watch)
string_from_object_4 = FromObject(obj=id_2)
addItemToFront_3 = List.AddItemToFront(item=string_from_object_4@L1, list=flatten@@L2)
addItemToFront_4 = List.AddItemToFront(item=string_from_object_3@L1, list=addItemToFront_3@@L2)

# group: Specify Directory Path for JSON Outputs
# note: User-specified output folder should
# be same for all JSON otuputs
directory_path = Directory("C:\_scratch\Project AA12345\20230608")  # graph input
string_4 = StringInput("\")
# note: End string with '\'
concat_2 = String.Concat(string0=directory_path, string1=string_4)
now = DateTime.Now()
# note: Optional: prefix file name with datestamp to distinguish multiple outputs from the same model
code_block_5 = CodeBlock { "yyMMdd-HHMMss"; }
# note: To add prefix, add new line to 'String.Concat' node and connect it to the 'string' output of the DateTime.Format node
format = DateTime.Format(dateTime=now, format=code_block_5)

# group: Name output JSON file: External References
string_5 = StringInput("ExternalReferences.json")
concat_3 = String.Concat(string0=concat_2, string1=string_5)

# group: Create dictionary, split out values and keys, export to JSON file
byKeysValues = DesignScript.Builtin.Dictionary.ByKeysValues(keys=addItemToFront_2@L2, values=addItemToFront_4@L2)
keys = DesignScript.Builtin.Dictionary.Keys(dictionary=byKeysValues)
values = DesignScript.Builtin.Dictionary.Values(dictionary=byKeysValues)
byKeysAndValues = JsonObject.ByKeysAndValues(keys=keys@L2, values=values@L2, Nesting=true, Option="None")
toJsonFile = JsonData.Utilities.Write.ToJsonFile(jsonObjects=byKeysAndValues, filepath=concat_3)
