# Dynamo graph Project Information and Vitals (2023).dyn (Dynamo 2.6.2.15705)
# packages: JsonData 2.0.2, archi-lab.net 2023.213.1722, spring nodes 210.1.1

# group: Project Information: Get data from 'Project Information' category elements
categories = Categories("OST_ProjectInformation")
all_elements_of_category = ElementsOfCategory(Category=categories)
code_block = CodeBlock()
# ---------- code_block.designscript (4 lines) ----------
["Project Name",
"Project Number",
"Project Status",
"S_D2Admin_TemplateVersion"];
# ----------------------------------------
# note: Get Parameter values (if they exist)
getParameterValueByName = Element.GetParameterValueByName(element=all_elements_of_category@L1, parameterName=code_block)
flatten = List.Flatten(list=getParameterValueByName)
# note: Get App Build and Full Version
# using Custom Python Node
# note: Custom Python scripts
# gets the model version
python_script = Python()
# ---------- python_script.python (11 lines) ----------
# Script modified from: https://forum.dynamobim.com/t/revit-build/19025/13
import sys
import clr
clr.AddReference("RevitServices")
import RevitServices
from RevitServices.Persistence import DocumentManager

uiapp = DocumentManager.Instance.CurrentUIApplication
app = uiapp.Application

OUT = app.VersionNumber
# ----------------------------------------
current = Document.Current()
filePath = Document.FilePath(document=current)
# note: Get file path, name, and size
fileName = FileSystem.FileName(path=filePath)
directoryName = FileSystem.DirectoryName(path=filePath)
ꟿ_filepath_size = Custom[ꟿ FilePath.Size](path=filePath)  # package spring nodes; Outputs the the file size in kilobytes or megabytes. Provide a file path as a string. Set kbOnly to true for a consistent output.

# group: Generate list of paired attributes and values
# note: Create list of Attribute names
code_block_2 = CodeBlock()
# ---------- code_block_2.designscript (8 lines) ----------
["Project Name",
"Project Number",
"Project Status",
"S_D2Admin_TemplateVersion",
"Revit Version",
"File Name",
"File Path",
"File Size"];
# ----------------------------------------
# note: Combine values into list;
list_create = List.Create(item0=flatten, item1=python_script, item2=fileName, item3=directoryName, item4=ꟿ_filepath_size)
code_block_3 = CodeBlock { 1; }
# note: Flatten to single dimension list
flatten_2 = List.Flatten(list=list_create, amt=code_block_3)
# note: Combine headers and values to single string to retain list length, even if values are empty
code_block_4 = CodeBlock(a=code_block_2, b=flatten_2) { a+"|"+b; }
code_block_5 = CodeBlock { "|"; }
# note: Split attributes from values to facilitate formatting in next step because empty values are automatically converted into empty lists. Empty lists are easier to identify and replace.
split = String.Split(str=code_block_4, separator0=code_block_5)

# group: Handle blank values and format lists for dictionary
# note: Create headers
code_block_6 = CodeBlock()
# ---------- code_block_6.designscript (2 lines) ----------
["Attribute",
"Value"];
# ----------------------------------------
code_block_7 = CodeBlock { 0; }
# note: Get list of attribute names only
getItemAtIndex = List.GetItemAtIndex(list=split@L2, index=code_block_7)
code_block_8 = CodeBlock { 0; }
# note: By removing attributes, blank values are converted to Empty Lists which can be easily replaced
removeItemAtIndex = List.RemoveItemAtIndex(list=split@L2, indices=code_block_8)
# note: Blank values need to be replaced
# with a delimiter to preserve list length
code_block_9 = CodeBlock { "-BLANK-"; }
replaceEmptyList = archilab.Lists.Lists.ReplaceEmptyList(list=removeItemAtIndex, replacement=code_block_9)
flatten_3 = List.Flatten(list=replaceEmptyList)
# note: Recombine lists and transpose back
# into attribute-value pairs
list_create_2 = List.Create(item0=getItemAtIndex, item1=flatten_3)
transpose = List.Transpose(lists=list_create_2)

# group: Specify Directory Path for JSON Outputs
# note: User-specified output folder is
#  same for all JSON otuputs
directory_path = Directory("C:\_scratch\Project AA12345\20230608")  # graph input
string = StringInput("\")
# note: End string with '\'
concat = String.Concat(string0=directory_path, string1=string)
now = DateTime.Now()
# note: Optional: prefix file name with datestamp to distinguish multiple outputs from the same model
code_block_10 = CodeBlock { "yyMMdd-HHMMss"; }
# note: To add prefix, add new line to 'String.Concat' node and connect it to the 'string' output of the DateTime.Format node
format = DateTime.Format(dateTime=now, format=code_block_10)

# group: Name output JSON file: Project Information
string_2 = StringInput("ProjectInformation.json")
concat_2 = String.Concat(string0=concat, string1=string_2)

# group: Define dictionary, split into keys and values, export to JSON
byKeysValues = DesignScript.Builtin.Dictionary.ByKeysValues(keys=code_block_6, values=transpose@L2)
keys = DesignScript.Builtin.Dictionary.Keys(dictionary=byKeysValues)
values = DesignScript.Builtin.Dictionary.Values(dictionary=byKeysValues)
byKeysAndValues = JsonObject.ByKeysAndValues(keys=keys@L2, values=values@L2, Nesting=true, Option="None")
toJsonFile = JsonData.Utilities.Write.ToJsonFile(jsonObjects=byKeysAndValues, filepath=concat_2)

# group: Warnings: Get list of instances by by Severity and Description
code_block_11 = CodeBlock { ["Severity","Description", "Index"]; }
current_2 = Document.Current()
getWarnings = Warning.GetWarnings(document=current_2)
# note: Get Warning Severity, Description, and Create Index to distinguish multiple instances
severity = Warning.Severity(warning=getWarnings)
description = Warning.Description(warning=getWarnings)
count = List.Count(list=getWarnings)
code_block_12 = CodeBlock(x=count) { 0..x-1; }
list_create_3 = List.Create(item0=severity, item1=description, item2=code_block_12)
# note: Combine items to single list,
# transpose so hierarchy is:
# L2 = element
# L1 = attribute
transpose_2 = List.Transpose(lists=list_create_3)

# group: Name output JSON file: Warning List
string_3 = StringInput("WarningsList.json")
concat_3 = String.Concat(string0=concat, string1=string_3)

# group: Define dictionary, split into keys and values, export to JSON
byKeysValues_2 = DesignScript.Builtin.Dictionary.ByKeysValues(keys=code_block_11, values=transpose_2@L2)
keys_2 = DesignScript.Builtin.Dictionary.Keys(dictionary=byKeysValues_2)
values_2 = DesignScript.Builtin.Dictionary.Values(dictionary=byKeysValues_2)
byKeysAndValues_2 = JsonObject.ByKeysAndValues(keys=keys_2@L2, values=values_2@L2, Nesting=true, Option="None")
toJsonFile_2 = JsonData.Utilities.Write.ToJsonFile(jsonObjects=byKeysAndValues_2, filepath=concat_3)

# group: Get Elements Associated with Warnings
# note: Archilab Node
getWarnings_2 = archilab.Revit.Elements.Warning.GetWarnings()
elements = archilab.Revit.Elements.Warning.Elements(warning=getWarnings_2)
# note: Get IDs for elements associated with warnings
id = archilab.Revit.Elements.WarningElement.Id(warningElement=elements)
byElementId = archilab.Revit.Selection.Select.ByElementId(id=id)
# note: Get GUID warning elements & covnert to string
uniqueId = Element.UniqueId(element=byElementId)
string_from_object = FromObject(obj=uniqueId)
# note: Convert EIDs to string
string_from_object_2 = FromObject(obj=id)
parameters = Element.Parameters(element=byElementId)
# note: Get Parameters for elements
# associated with warnings
string_from_object_3 = FromObject(obj=parameters)
count_2 = List.Count(list=getWarnings_2)
# note: Create index for Warnings (Start at 0)
code_block_13 = CodeBlock(x=count_2) { 0..x-1; }

# group: For Elements Associated with Warnings, get Category, Family, and Type
code_block_14 = CodeBlock { "Category :"; }
# note: Get values for Category parameter, preserving elements even if values are blank
contains = String.Contains(str=string_from_object_3, searchFor=code_block_14)
filterByBoolMask = List.FilterByBoolMask(list=string_from_object_3, mask=contains)
code_block_15 = CodeBlock { "Category: -BLANK-"; }
# note: Replace empty lists with special
# value to help with data parsing
replaceEmptyList_2 = archilab.Lists.Lists.ReplaceEmptyList(list=filterByBoolMask.in, replacement=code_block_15)
# note: Get values for Family and Type parameter, preserving elements even if values are blank
code_block_16 = CodeBlock { "Family and Type :"; }
contains_2 = String.Contains(str=string_from_object_3, searchFor=code_block_16)
filterByBoolMask_2 = List.FilterByBoolMask(list=string_from_object_3, mask=contains_2)
code_block_17 = CodeBlock { "Family and Type : -BLANK-"; }
replaceEmptyList_3 = archilab.Lists.Lists.ReplaceEmptyList(list=filterByBoolMask_2.in, replacement=code_block_17)

# note: Only need first instance of Category
deconstruct = List.Deconstruct(list=replaceEmptyList_2@@L2)

# group (continued): For Elements Associated with Warnings, get Category, Family, and Type
# note: Combine Lists for
# Element Category and Family Type
# note: L2 = Element
# L1 = Attributes
addItemToFront = List.AddItemToFront(item=deconstruct.first@L1, list=replaceEmptyList_3@@L2)

# group: Add Element EID, and Element GUID for each element associated with a warning
code_block_18 = CodeBlock { "Element GUID : "; }
code_block_19 = CodeBlock(x=code_block_18, y=string_from_object) { x+y; }
code_block_20 = CodeBlock { "Element EID : "; }
code_block_21 = CodeBlock(x=code_block_20, y=string_from_object_2) { x+y; }
# note: Add Element EID to Nested List
addItemToFront_2 = List.AddItemToFront(item=code_block_21@@L1, list=addItemToFront@L2)
# note: Add Element GUID to Nested List
addItemToFront_3 = List.AddItemToFront(item=code_block_19@@L1, list=addItemToFront_2@L2)

# group: Split headers from values, nest lists, and create dictionary
code_block_22 = CodeBlock { "Warning Index"; }
code_block_23 = CodeBlock { " : "; }
# note: Split header name from value
split_2 = String.Split(str=addItemToFront_3@@L1, separator0=code_block_23)
code_block_24 = CodeBlock { 0; }
getItemAtIndex_2 = List.GetItemAtIndex(list=split_2@@L2, index=code_block_24)
# note: Add header for Warning Index
addItemToFront_4 = List.AddItemToFront(item=code_block_22, list=getItemAtIndex_2@@L3)
code_block_25 = CodeBlock { 0; }
removeItemAtIndex_2 = List.RemoveItemAtIndex(list=split_2@@L2, indices=code_block_25)
code_block_26 = CodeBlock { "-BLANK-"; }
# note: Preserve list length by replacing
# Empty lists with special value
replaceEmptyList_4 = archilab.Lists.Lists.ReplaceEmptyList(list=removeItemAtIndex_2, replacement=code_block_26)
# note: Add index of warning to warning element by preserving structure of warning list (item)
addItemToFront_5 = List.AddItemToFront(item=code_block_13@@L1, list=replaceEmptyList_4@L4)
code_block_27 = CodeBlock { 1; }
# note: Flatten for dictionary
flatten_4 = List.Flatten(list=addItemToFront_5@@L3, amt=code_block_27)

# group: Name output JSON file: Warning Elements
string_4 = StringInput("WarningsElements.json")
concat_4 = String.Concat(string0=concat, string1=string_4)

# group: Define dictionary, split into keys and values, export to JSON
byKeysValues_3 = DesignScript.Builtin.Dictionary.ByKeysValues(keys=addItemToFront_4@L2, values=flatten_4@@L2)
keys_3 = DesignScript.Builtin.Dictionary.Keys(dictionary=byKeysValues_3)
values_3 = DesignScript.Builtin.Dictionary.Values(dictionary=byKeysValues_3)
byKeysAndValues_3 = JsonObject.ByKeysAndValues(keys=keys_3@L2, values=values_3@L2, Nesting=true, Option="None")
toJsonFile_3 = JsonData.Utilities.Write.ToJsonFile(jsonObjects=byKeysAndValues_3, filepath=concat_4)
