# Dynamo graph Standards and Quality Control (2023).dyn (Dynamo 2.6.2.15705)
# packages: archi-lab.net 2023.213.1722, JsonData 2.0.2

# group: Get Object Style Names, EID, and GUID
# note: Start with all ements of GraphicsStyle Type
element_types = ElementTypes("GraphicsStyle")
all_elements_of_type = ElementsOfType(element_type=element_types)
parameters = Element.Parameters(element=all_elements_of_type)
string_from_object = FromObject(obj=parameters)
code_block = CodeBlock { "Object Styles"; }
# note: Determine if each element contains
# the 'Object Styles' parameter
contains = String.Contains(str=string_from_object, searchFor=code_block)
boolean = BoolSelector(true)
contains_2 = List.Contains(item=boolean)  # unwired: list
map = List.Map(list=contains, f_x=contains_2)
# note: Keep elements with object style parameter
filterByBoolMask = List.FilterByBoolMask(list=all_elements_of_type, mask=map)
# note: Get Name, ID, GUID of elements
name = Element.Name(element=filterByBoolMask.in)
id = Element.Id(element=filterByBoolMask.in)
uniqueId = Element.UniqueId(element=filterByBoolMask.in)

# group: Create dictionary of object styles
code_block_2 = CodeBlock()
# ---------- code_block_2.designscript (3 lines) ----------
["Object Style Name",
"Object Style EID",
"Object Style GUID"];
# ----------------------------------------
# note: Combine lists and create headers
list_create = List.Create(item0=name, item1=id, item2=uniqueId)
# note: Transpose to create hierarchy:
# L2 = element
# L1 = parameter values
transpose = List.Transpose(lists=list_create)

# group: Specify Directory Path for JSON Outputs
# note: User-specified output folder should
# be same for all JSON otuputs
directory_path = Directory("C:\_scratch\Project AA12345\20230608")  # graph input
string = StringInput("\")
# note: End string with '\'
concat = String.Concat(string0=directory_path, string1=string)
now = DateTime.Now()
# note: Optional: prefix file name with datestamp to distinguish multiple outputs from the same model
code_block_3 = CodeBlock { "yyMMdd-HHMMss"; }
# note: To add prefix, add new line to 'String.Concat' node and connect it to the 'string' output of the DateTime.Format node
format = DateTime.Format(dateTime=now, format=code_block_3)

# group: Name output JSON file: Object Styles
string_2 = StringInput("StylesObjects.json")
concat_2 = String.Concat(string0=concat, string1=string_2)

# group: Define dictionary, split into keys and values, export to JSON
byKeysValues = DesignScript.Builtin.Dictionary.ByKeysValues(keys=code_block_2, values=transpose@L2)
keys = DesignScript.Builtin.Dictionary.Keys(dictionary=byKeysValues)
values = DesignScript.Builtin.Dictionary.Values(dictionary=byKeysValues)
byKeysAndValues = JsonObject.ByKeysAndValues(keys=keys@L2, values=values@L2, Nesting=true, Option="None")
toJsonFile = JsonData.Utilities.Write.ToJsonFile(jsonObjects=byKeysAndValues, filepath=concat_2)

# group: Get Line Style Names, EID and GUID
# note: archi-lab node
get_all_line_styles = Custom[Get All Line Styles]()  # package archi-lab.net; This node will return all available line styles.
name_2 = Element.Name(element=get_all_line_styles)
id_2 = Element.Id(element=get_all_line_styles)
uniqueId_2 = Element.UniqueId(element=get_all_line_styles)

# group: Split headers and values
# note: This is a unique list rather than list of elements
code_block_4 = CodeBlock()
# ---------- code_block_4.designscript (3 lines) ----------
["Line Style Name",
"Line Style EID",
"Line Style GUID"];
# ----------------------------------------
list_create_2 = List.Create(item0=name_2, item1=id_2, item2=uniqueId_2)
transpose_2 = List.Transpose(lists=list_create_2)

# group: Name output JSON file: Line Style
string_3 = StringInput("StylesLines.json")
concat_3 = String.Concat(string0=concat, string1=string_3)

# group: Define dictionary, split into keys and values, export to JSON
byKeysValues_2 = DesignScript.Builtin.Dictionary.ByKeysValues(keys=code_block_4, values=transpose_2@L2)
keys_2 = DesignScript.Builtin.Dictionary.Keys(dictionary=byKeysValues_2)
values_2 = DesignScript.Builtin.Dictionary.Values(dictionary=byKeysValues_2)
byKeysAndValues_2 = JsonObject.ByKeysAndValues(keys=keys_2@L2, values=values_2@L2, Nesting=true, Option="None")
toJsonFile_2 = JsonData.Utilities.Write.ToJsonFile(jsonObjects=byKeysAndValues_2, filepath=concat_3)

# group: Get Phase Names and Sequence
# note: Python script gets unique
# list of phases as elements
python_script = Python()
# ---------- python_script.python (18 lines) ----------
import clr
clr.AddReference('RevitAPI')
from Autodesk.Revit.DB import *
import Autodesk

clr.AddReference("RevitNodes")
import Revit
clr.ImportExtensions(Revit.Elements)

clr.AddReference("RevitServices")
import RevitServices
from RevitServices.Persistence import DocumentManager

doc = DocumentManager.Instance.CurrentDBDocument
elementlist = []
for phase in doc.Phases:
	elementlist.append(phase.ToDSType(True))
OUT = elementlist
# ----------------------------------------
name_3 = Element.Name(element=python_script)
code_block_5 = CodeBlock { "Sequence Number"; }
# note: Get value of Sequence Number parameter
getParameterValueByName = Element.GetParameterValueByName(element=python_script, parameterName=code_block_5)

# group: Combine lists, transpose, and create headers
# note: Create headers
code_block_6 = CodeBlock { ["Name", "Sequence Number"]; }
# note: Combine phase numbers and
# names into single tiered list
list_create_3 = List.Create(item0=name_3, item1=getParameterValueByName)
# note: Transpose so that level hierarchy is:
# L2 = phase
# L1 = parameter values
transpose_3 = List.Transpose(lists=list_create_3)

# group: Name output JSON file: Phases
string_4 = StringInput("Phases.json")
concat_4 = String.Concat(string0=concat, string1=string_4)

# group: Define dictionary, split into keys and values, export to JSON
byKeysValues_3 = DesignScript.Builtin.Dictionary.ByKeysValues(keys=code_block_6, values=transpose_3@L2)
keys_3 = DesignScript.Builtin.Dictionary.Keys(dictionary=byKeysValues_3)
values_3 = DesignScript.Builtin.Dictionary.Values(dictionary=byKeysValues_3)
byKeysAndValues_3 = JsonObject.ByKeysAndValues(keys=keys_3@L2, values=values_3@L2, Nesting=true, Option="None")
toJsonFile_3 = JsonData.Utilities.Write.ToJsonFile(jsonObjects=byKeysAndValues_3, filepath=concat_4)

getAll = archilab.Revit.Elements.Categories.GetAll()
all_elements_of_category = ElementsOfCategory(Category=getAll.Model)
code_block_7 = CodeBlock { false; }
# note: Get all model elements, clean list of empty / null
clean = List.Clean(list=all_elements_of_category, preserveIndices=code_block_7)
# note: Flatten list and get parameter value for Design Option for all elements
flatten = List.Flatten(list=clean)
code_block_8 = CodeBlock { "Design Option"; }
getParameterValueByName_2 = Element.GetParameterValueByName(element=flatten, parameterName=code_block_8)

# group: Filter elements with trivial values, get names of Design Option, Option, and Option Set
# note: Find elements where parameter value for
# 'Design Option' = -1 and filter them out of list
code_block_9 = CodeBlock { "-1"; }
code_block_10 = CodeBlock(y=code_block_9, x=getParameterValueByName_2) { y==x; }
# note: Filter only to Model elements with real values; convert elements to String (Element)
filterByBoolMask_2 = List.FilterByBoolMask(list=flatten, mask=code_block_10)
string_from_object_2 = FromObject(obj=filterByBoolMask_2.out)
filterByBoolMask_3 = List.FilterByBoolMask(list=getParameterValueByName_2, mask=code_block_10)
code_block_11 = CodeBlock { "Design Option Set Id"; }
# note: Get the Design Option Set ID
# then extract Element's name
getParameterValueByName_3 = Element.GetParameterValueByName(element=filterByBoolMask_3.out, parameterName=code_block_11)
name_4 = Element.Name(element=getParameterValueByName_3)
# note: Get name of the Option within the Option Set
name_5 = Element.Name(element=filterByBoolMask_3.out)

# group: Combine values into single list, prepare headers for dictionary
# note: Create Headers for dictionary
code_block_12 = CodeBlock { ["Design Option Name","Option Set","Option"]; }
# note: Combine lists, then transpose so that hierarchy is:
# L1 = Values (Element ID, Option Set, Option)
# L2 = Model element
list_create_4 = List.Create(item0=string_from_object_2, item1=name_4, item2=name_5)
transpose_4 = List.Transpose(lists=list_create_4)

# group: Name output JSON file: Design Options
# note: Ordered by appearance in map,
# from top to bottom
string_5 = StringInput("DesignOptions.json")
# note: If you change file names, must also
# change names in Power BI report
concat_5 = String.Concat(string0=concat, string1=string_5)

# group: Define dictionary, split into keys and values, export to JSON
byKeysValues_4 = DesignScript.Builtin.Dictionary.ByKeysValues(keys=code_block_12, values=transpose_4@L2)
keys_4 = DesignScript.Builtin.Dictionary.Keys(dictionary=byKeysValues_4@L2)
values_4 = DesignScript.Builtin.Dictionary.Values(dictionary=byKeysValues_4@L2)
byKeysAndValues_4 = JsonObject.ByKeysAndValues(keys=keys_4@L2, values=values_4@L2, Nesting=true, Option="None")
toJsonFile_4 = JsonData.Utilities.Write.ToJsonFile(jsonObjects=byKeysAndValues_4, filepath=concat_5)
