# Dynamo graph View Related (2023).dyn (Dynamo 2.6.2.15705)
# packages: archi-lab.net 2023.213.1722, JsonData 2.0.2

# group: Sheets: Get all elements of Sheets category
categories = Categories("OST_Sheets")
# note: Get all elements of Sheets category
all_elements_of_category = ElementsOfCategory(Category=categories)
isNull = Object.IsNull(obj=all_elements_of_category)
# note: Remove null elements
filterByBoolMask = List.FilterByBoolMask(list=all_elements_of_category, mask=isNull)

# group: Views: Get all elements of View category
categories_2 = Categories("OST_Views")
# note: Get all elements of Views category
all_elements_of_category_2 = ElementsOfCategory(Category=categories_2)
isNull_2 = Object.IsNull(obj=all_elements_of_category_2)
# note: Remove null elements
filterByBoolMask_2 = List.FilterByBoolMask(list=all_elements_of_category_2, mask=isNull_2)
isViewTemplate = View.IsViewTemplate(view=filterByBoolMask_2.out)

list_create = List.Create(item0=filterByBoolMask_2.out)

# group (continued): Views: Get all elements of View category
# note: Remove view templates
filterByBoolMask_3 = List.FilterByBoolMask(list=list_create, mask=isViewTemplate)

# group: Merge Sheets and Views
list_create_2 = List.Create(item0=filterByBoolMask.out, item1=filterByBoolMask_3.out)
flatten = List.Flatten(list=list_create_2)

# group: Parameters: Get unique list of IDs, Names, and Values
# note: Parameters: Get unique list of IDs, Names, and Values
parameters = Element.Parameters(element=flatten)
string_from_object = FromObject(obj=parameters)
code_block = CodeBlock { "."; ""; }
replace = String.Replace(str=string_from_object, searchFor=code_block.out0, replaceWith=code_block.out1)
id = Parameter.Id(parameter=parameters)
string_from_object_2 = FromObject(obj=id)
# note: Need to join ID/Name/Value first to find unique list, then split out to handle blank values (null or empty lists)
code_block_2 = CodeBlock(x=string_from_object_2, y=string_from_object) { x+"|"+y; }
uniqueItems = List.UniqueItems(list=code_block_2)

# group: Schedules: Get all Elements of viewType
# note: Get all elements of Schedule View Type,
# then extract all parameters
view_type = ViewTypesUi("Schedule")
getByType = archilab.Revit.Views.Views.GetByType(viewType=view_type)
parameters_2 = Element.Parameters(element=getByType)
id_2 = Parameter.Id(parameter=parameters_2)
# note: Get Parameter ID, convert to string
string_from_object_3 = FromObject(obj=id_2)
string_from_object_4 = FromObject(obj=parameters_2)
string = StringInput(" : ")
boolean = BoolSelector(true)
indexOf = String.IndexOf(str=string_from_object_4, searchFor=string, ignoreCase=boolean)
length = String.Length(str=string_from_object_4)
sub = length - indexOf
# note: Remove header by finding index
# of " : " value within the string
remove = String.Remove(str=string_from_object_4, startIndex=indexOf, count=sub)
code_block_3 = CodeBlock { 0; }
length_2 = String.Length(str=remove)
code_block_4 = CodeBlock { 3; }
add = length_2 + code_block_4
# note: Remove characters before
# parameter value
remove_2 = String.Remove(str=string_from_object_4, startIndex=code_block_3, count=add)
# note: Combine so that each parameter includes the parameters ID|Name#Value as a single string
code_block_5 = CodeBlock(x=string_from_object_3, y=remove, z=remove_2) { x+"|"+y+"#"+z; }
code_block_6 = CodeBlock { "#"; }
split = String.Split(str=code_block_5, separator0=code_block_6)

# group: Add headers for parameter EID and GUID
code_block_7 = CodeBlock { "Schedule View GUID|Schedule View GUID"; }
code_block_8 = CodeBlock { "Schedule View EID|Schedule View EID"; }
code_block_9 = CodeBlock { 0; }
getItemAtIndex = List.GetItemAtIndex(list=split@@L2, index=code_block_9)
addItemToFront = List.AddItemToFront(item=code_block_8, list=getItemAtIndex@@L2)
addItemToFront_2 = List.AddItemToFront(item=code_block_7, list=addItemToFront@L2)

watch = Watch(getByType)

# group: Add element ID and GUID values to front of the list
code_block_10 = CodeBlock { 1; }
uniqueId = Element.UniqueId(element=watch)
id_3 = Element.Id(element=watch)
code_block_11 = CodeBlock { 0; }
removeItemAtIndex = List.RemoveItemAtIndex(list=split@@L2, indices=code_block_11)
code_block_12 = CodeBlock { "-BLANK-"; }
# note: Replace empty lists to preserve list length
replaceEmptyList = archilab.Lists.Lists.ReplaceEmptyList(list=removeItemAtIndex, replacement=code_block_12)
# note: Flatten to preserve structure:
# L2 = elements
# L1 = parameter or attribute values
flatten_2 = List.Flatten(list=replaceEmptyList@L3)
addItemToFront_3 = List.AddItemToFront(item=id_3@L1, list=flatten_2@@L2)
addItemToFront_4 = List.AddItemToFront(item=uniqueId@L1, list=addItemToFront_3@@L2)

# group: Specify Directory Path for JSON Outputs
# note: User-specified output folder should
# be same for all JSON otuputs
directory_path = Directory("C:\_scratch\Project AA12345\20230608")  # graph input
string_2 = StringInput("\")
# note: End string with '\'
concat = String.Concat(string0=directory_path, string1=string_2)
now = DateTime.Now()
# note: Optional: prefix file name with datestamp to distinguish multiple outputs from the same model
code_block_13 = CodeBlock { "yyMMdd-HHMMss"; }
# note: To add prefix, add new line to 'String.Concat' node and connect it to the 'string' output of the DateTime.Format node
format = DateTime.Format(dateTime=now, format=code_block_13)

# group: Name output JSON file: Schedules
string_3 = StringInput("Schedules.json")
concat_2 = String.Concat(string0=concat, string1=string_3)

# group: Define dictionary, split into keys and values, export to JSON
byKeysValues = DesignScript.Builtin.Dictionary.ByKeysValues(keys=addItemToFront_2@L2, values=addItemToFront_4@L2)
keys = DesignScript.Builtin.Dictionary.Keys(dictionary=byKeysValues)
values = DesignScript.Builtin.Dictionary.Values(dictionary=byKeysValues)
byKeysAndValues = JsonObject.ByKeysAndValues(keys=keys@L2, values=values@L2, Nesting=true, Option="None")
toJsonFile = JsonData.Utilities.Write.ToJsonFile(jsonObjects=byKeysAndValues, filepath=concat_2)

# group: Split Parameter ID/Name from Values
code_block_14 = CodeBlock { "GUID|GUID"; }
# note: Add EID and GUID to list,
# with | delimiter for data processing
code_block_15 = CodeBlock { "EID|EID"; }
code_block_16 = CodeBlock { " : "; }
split_2 = String.Split(str=uniqueItems, separator0=code_block_16)
code_block_17 = CodeBlock { 0; }
# note: Index 0 = Header value
getItemAtIndex_2 = List.GetItemAtIndex(list=split_2@@L2, index=code_block_17)
# note: Add placeholder for Parameter EID and GUID
addItemToFront_5 = List.AddItemToFront(item=code_block_15, list=getItemAtIndex_2@L2)
addItemToFront_6 = List.AddItemToFront(item=code_block_14, list=addItemToFront_5@L2)

watch_2 = Watch(flatten)

# group: Handle blank Parameter values
# note: Need to rejoin strings for Scale since components also typically separated by " : " delimiter
code_block_18 = CodeBlock { ":"; }
code_block_19 = CodeBlock { 0; }
removeItemAtIndex_2 = List.RemoveItemAtIndex(list=split_2@@L2, indices=code_block_19)
code_block_20 = CodeBlock { "-BLANK-"; }
# note: Replace empty lists with special
# value to preserve list length
replaceEmptyList_2 = archilab.Lists.Lists.ReplaceEmptyList(list=removeItemAtIndex_2, replacement=code_block_20)
# note: Concatenate parameters with multiple values, then flatten to preserve list length
join = String.Join(separator=code_block_18, string0=replaceEmptyList_2@@L2)
code_block_21 = CodeBlock { 1; }
flatten_3 = List.Flatten(list=join, amt=code_block_21)

# group: Add Element ID + GUID to Parameter Values
uniqueId_2 = Element.UniqueId(element=watch_2)
string_from_object_5 = FromObject(obj=uniqueId_2)
id_4 = Element.Id(element=watch_2)
string_from_object_6 = FromObject(obj=id_4)
addItemToFront_7 = List.AddItemToFront(item=string_from_object_6@L1, list=flatten_3@@L2)
addItemToFront_8 = List.AddItemToFront(item=string_from_object_5@L1, list=addItemToFront_7@@L2)

# group: Name output JSON file: Views & Sheets
string_4 = StringInput("ViewsSheets.json")
concat_3 = String.Concat(string0=concat, string1=string_4)

# group: Define dictionary, split into keys and values, export to JSON
byKeysValues_2 = DesignScript.Builtin.Dictionary.ByKeysValues(keys=addItemToFront_6@L2, values=addItemToFront_8@L2)
keys_2 = DesignScript.Builtin.Dictionary.Keys(dictionary=byKeysValues_2)
values_2 = DesignScript.Builtin.Dictionary.Values(dictionary=byKeysValues_2)
byKeysAndValues_2 = JsonObject.ByKeysAndValues(keys=keys_2@L2, values=values_2@L2, Nesting=true, Option="None")
toJsonFile_2 = JsonData.Utilities.Write.ToJsonFile(jsonObjects=byKeysAndValues_2, filepath=concat_3)

# group: Create headers
# note: All 8 headers must be same
# order as values in list
code_block_22 = CodeBlock()
# ---------- code_block_22.designscript (4 lines) ----------
["Element GUID", "Element ID",
"Element Name", "Family",
"Type", "Sheet Name",
"Sheet Number", "Scale"];
# ----------------------------------------

# group: Title Blocks: Get All Elements of Category
categories_3 = Categories("OST_TitleBlocks")
all_elements_of_category_3 = ElementsOfCategory(Category=categories_3)

# group: Get Element parameter Family and Type, then add stage to put in front of list
# note: Values for Family and Type are stuck together, so need to isolate both values from headers
code_block_23 = CodeBlock { "Family and Type"; }
getParameterValueByName = Element.GetParameterValueByName(element=all_elements_of_category_3@@L1, parameterName=code_block_23)
string_from_object_7 = FromObject(obj=getParameterValueByName)
code_block_24 = CodeBlock { ", "; }
# note: First, split parameter into two items of sublist
split_3 = String.Split(str=string_from_object_7@@L1, separator0=code_block_24)
code_block_25 = CodeBlock { ": "; }
# note: Split headers from values
split_4 = String.Split(str=split_3@@L1, separator0=code_block_25)
code_block_26 = CodeBlock { 0; }
# note: Remove headers and flatten list to preserve levels
removeItemAtIndex_3 = List.RemoveItemAtIndex(list=split_4@@L2, indices=code_block_26)
flatten_4 = List.Flatten(list=removeItemAtIndex_3@@L3)

# group: Add Sheet Name, Number, and Scale to back of list
code_block_27 = CodeBlock()
# ---------- code_block_27.designscript (3 lines) ----------
["Sheet Name",
"Sheet Number",
"Scale"];
# ----------------------------------------
getParameterValueByName_2 = Element.GetParameterValueByName(element=all_elements_of_category_3@@L1, parameterName=code_block_27)
addItemToFront_9 = List.AddItemToFront(item=flatten_4@L2, list=getParameterValueByName_2@L2)
# note: Flatten to preserve levels
flatten_5 = List.Flatten(list=addItemToFront_9@L3)

# group: Add Element ID, GUID, and Name to front of list
# note: Want ID, GUID, and Name to be first
# items in the list for each element
uniqueId_3 = Element.UniqueId(element=all_elements_of_category_3)
id_5 = Element.Id(element=all_elements_of_category_3)
string_from_object_8 = FromObject(obj=id_5)
name = Element.Name(element=all_elements_of_category_3)
# note: Combine values into single tiered list
list_create_3 = List.Create(item0=uniqueId_3, item1=string_from_object_8, item2=name)
# note: Transpose so that hierarchy is:
# L2 = Element
# L1 = Parameter value
transpose = List.Transpose(lists=list_create_3)
addItemToFront_10 = List.AddItemToFront(item=transpose@L2, list=flatten_5@L2)
# note: Flatten to preserve levels
flatten_6 = List.Flatten(list=addItemToFront_10@L3)

# group: Name output JSON file: Titleblocks
string_5 = StringInput("Titleblocks.json")
concat_4 = String.Concat(string0=concat, string1=string_5)

# group: Define dictionary, split into keys and values, export to JSON
byKeysValues_3 = DesignScript.Builtin.Dictionary.ByKeysValues(keys=code_block_22, values=flatten_6@L2)
keys_3 = DesignScript.Builtin.Dictionary.Keys(dictionary=byKeysValues_3)
values_3 = DesignScript.Builtin.Dictionary.Values(dictionary=byKeysValues_3)
byKeysAndValues_3 = JsonObject.ByKeysAndValues(keys=keys_3@L2, values=values_3@L2, Nesting=true, Option="None")
toJsonFile_3 = JsonData.Utilities.Write.ToJsonFile(jsonObjects=byKeysAndValues_3, filepath=concat_4)
