# Dynamo graph Session 212 - Dynamo Patterns and Templates.dyn (Dynamo 2.6.2.15705)
# packages: JsonData 2.0.2

# group: Template Node Groups for generating File Output Paths and JSON Dictionaries
# note: You can copy and replace groups of pink nodes in the main Dynamo files to adjust how the File name is specified (with or without a prefix).
# note: You can also copy the output JSON step (Green groups) to create new JSON outputs that follow the same format. Just be sure to adjust the levels of the Dictionary creation steps (keys/values) as necessary
# note: By default, all templates currently use the NO File name Prefix option. This is easier for the demo as you can just create a new folder and select it with the Directory Path Node

# group: Specify Output Directory Path
# note: Multiple outputs, same root directory
# note: User-specified output folder should be
# the same for all JSON otuputs
directory_path = Directory("C:\_scratch\Project AA12345\20230608")
string = StringInput("\")
# note: End string with '\'
concat = String.Concat(string0=directory_path, string1=string)

# group: JSON OUTPUT 1 FILE NAME
string_2 = StringInput("ProjectInformation.json")
# note: Add File Name to String
concat_2 = String.Concat(string0=concat, string1=string_2)

# group: EXPORT OUTPUT 1 to JSON
# note: CONNECT LIST HEADERS TO 'KEYS'
# CONNVALUE LIST VALUES TO 'VALUES'
byKeysValues = DesignScript.Builtin.Dictionary.ByKeysValues()  # unwired: keys, values
keys = DesignScript.Builtin.Dictionary.Keys(dictionary=byKeysValues)
values = DesignScript.Builtin.Dictionary.Values(dictionary=byKeysValues)
byKeysAndValues = JsonObject.ByKeysAndValues(keys=keys@L2, values=values@L2, Nesting=true, Option="None")
# note: to dictionary node...
toJsonFile = JsonData.Utilities.Write.ToJsonFile(jsonObjects=byKeysAndValues, filepath=concat_2)

# group: JSON OUTPUT 2 FILE NAME
string_3 = StringInput("ExternalReferences.json")
# note: Add File Name to String
concat_3 = String.Concat(string0=concat, string1=string_3)

# group: EXPORT OUTPUT 2 to JSON
# note: CONNECT LIST HEADERS TO 'KEYS'
# CONNVALUE LIST VALUES TO 'VALUES'
byKeysValues_2 = DesignScript.Builtin.Dictionary.ByKeysValues()  # unwired: keys, values
keys_2 = DesignScript.Builtin.Dictionary.Keys(dictionary=byKeysValues_2)
values_2 = DesignScript.Builtin.Dictionary.Values(dictionary=byKeysValues_2)
byKeysAndValues_2 = JsonObject.ByKeysAndValues(keys=keys_2@L2, values=values_2@L2, Nesting=true, Option="None")
toJsonFile_2 = JsonData.Utilities.Write.ToJsonFile(jsonObjects=byKeysAndValues_2, filepath=concat_3)

# group: File Output Path (INCLUDE File Name Prefix)
# note: User-specified output folder is
#  same for all JSON otuputs
directory_path_2 = Directory("C:\Users\jferacor\Thornton Tomasetti, Inc\IT - D2 Management - _Conferences\2023\DBWa\Model Health Reports with Dynamo\DBWA Demonstration Files\JSON Outputs\Project AA12345\20230601")
# note: To add prefix, add new line to 'String.Concat' node and connect it to the 'string' output of the DateTime.Format node
string_4 = StringInput("\")
now = DateTime.Now()
# note: Optional: prefix file name with datestamp to distinguish multiple outputs from the same model
# note: Multiple outputs, same root directory, includes datestamp prefix for file names
code_block = CodeBlock { "yyMMdd-HHMM_"; }
format = DateTime.Format(dateTime=now, format=code_block)
# note: Combine folder with prefix
concat_4 = String.Concat(string0=directory_path_2, string1=string_4, string2=format)

# group: JSON OUTPUT 1 FILE NAME
string_5 = StringInput("ProjectInformation.json")
concat_5 = String.Concat(string0=concat_4, string1=string_5)

# group: JSON OUTPUT 2 FILE NAME
string_6 = StringInput("WarningsList.json")
concat_6 = String.Concat(string0=concat_4, string1=string_6)

# group: WATCH NODES
watch = Watch(concat_5)
watch_2 = Watch(concat_6)
